# Grasshopper definition 180924.gh (Grasshopper 0.9.76)
# plug-ins: Python Interpreter, Kangaroo2 Components

# ----
# INPUT
space_around_element = Slider(58.7, range=0..380)
number_slider = Slider(24, range=0..50)
curve_sampling = Slider(48, range=3..80)
area_width_max = Slider(1061, range=1..4000)
element_count = Slider(465, range=10..500)
max_shift = Slider(300, range=0..500)
reset_colider = Button()
list = ValueList({"Simple": 0, "Distance Check": 1}, selected="Distance Check")
control_curve = Curve(reparameterize(<curve referenced from the Rhino model>))

shift_seed = DigitScroller(Scroller_Digits=12, Scroller_Prefix="Shift Seed", Scroller_Radix=11, Scroller_Value=55)
min_distance = Number(space_around_element)
sampling = Number(curve_sampling)
gate = Integer(list)
count = Integer(element_count)
reset = Boolean(reset_colider)
max_shift_2 = Number(max_shift)
max_width = Number(area_width_max)
curve = Curve(control_curve)
cir = Circle(Plane=PlaneXY(0, 0, 0), Radius=number_slider)
shift_seef = Integer(shift_seed)
multiplication = Multiplication(A=number_slider, B=Slider(1.1, range=0..4))
range = Range(Domain=Domain(0, 1), Steps=Slider(3, range=2..5))
eval = EvaluateCurve(Curve=reparameterize(cir), Parameter=range)  # -> Point, Tangent, Angle

# ----
# Guide Surface from Curve
sampling_2 = Number(curve_sampling)
max_width_2 = Number(area_width_max)
curve_2 = Curve(control_curve)
range_2 = Range(Domain=Domain(0, 1), Steps=expr("x-1", sampling_2))
dom = ConstructDomain(DomainStart=0, DomainEnd=max_width_2)
hframe = HorizontalFrame(Curve=curve_2, Parameter=range_2)
graph = GraphMapper(
    range_2,
    x0=0,
    x1=1,
    y0=0,
    y1=1,
    container_name="Bezier",
    cpx=[0, 0, 0.6648901701, 1],
    cpy=[0.1366217732, 1, 0.6424783468, 0.1621391177])
deplane = DeconstructPlane(Plane=hframe)  # -> Origin, XAxis, YAxis, ZAxis
remap = RemapNumbers(Value=graph, Source=Domain(0, 1), Target=dom)  # -> Mapped, Clipped
amp = Amplitude(Vector=deplane.YAxis, Amplitude=remap.Clipped)
move = Move(Geometry=deplane.Origin, Motion=expr("-x", amp))  # -> Geometry, Transform
move_2 = Move(Geometry=deplane.Origin, Motion=amp)  # -> Geometry, Transform
intcrv = Interpolate(Vertices=move.Geometry, Degree=3, Periodic=False, KnotStyle=1)  # -> Curve, Length, Domain
intcrv_2 = Interpolate(Vertices=move_2.Geometry, Degree=3, Periodic=False, KnotStyle=1)  # -> Curve, Length, Domain
rulesrf = RuledSurface(CurveA=intcrv_2.Curve, CurveB=intcrv.Curve)
guide_surface = Surface(rulesrf)

cir_2 = Circle(Plane=eval.Point, Radius=multiplication)
sampling_ratio = Slider(17, range=1..20)
lenght = Slider(800.9, range=1..2000)
filet_radius = Slider(11, range=0..200)
runion = RegionUnion(Curves=cir_2)
len = Length(Curve=runion)
element_length = Number(lenght)
int = Integer(sampling_ratio)
num = Number(Slider(112, range=0..360))
sort = SortList(Keys=len, ValuesA=runion)  # -> Keys, ValuesA
item = ListItem(List=reverse(sort.ValuesA), Index=0, Wrap=True)
num_2 = Number(filet_radius)
dom_2 = ConstructDomain(DomainStart=0, DomainEnd=num)
dom_3 = ConstructDomain(DomainStart=0, DomainEnd=element_length)
range_3 = Range(Domain=Domain(0, 1), Steps=int)
fillet = Fillet(Curve=item, Radius=num_2)
graph_2 = GraphMapper(
    range_3,
    x0=0,
    x1=1,
    y0=0,
    y1=1,
    container_name="Bezier",
    cpx=[0, 0.3817386329, 0.6643322706, 1],
    cpy=[0.9568119049, 0.6924642324, 0.4988933802, 0.2669668794])
remap_2 = RemapNumbers(Value=range_3, Source=Domain(0, 1), Target=dom_3)  # -> Mapped, Clipped
remap_3 = RemapNumbers(Value=range_3, Source=Domain(0, 1), Target=dom_2)  # -> Mapped, Clipped
Z = UnitZ(Factor=remap_2.Clipped)
scale = Scale(Geometry=fillet, Center=Point(0, 0, 0), Factor=Slider(0.72, range=0..1))  # -> Geometry, Transform
move_3 = Move(Geometry=fillet, Motion=Z)  # -> Geometry, Transform
move_4 = Move(Geometry=scale.Geometry, Motion=Z)  # -> Geometry, Transform

# ----
# Point Population & Solver
# DATA DAM >>>>>
guide_surface_2 = Brep(guide_surface)
guide_surface_3 = Surface(guide_surface)
min_distance_2 = Number(space_around_element)
count_2 = Integer(element_count)
gate_2 = Integer(list)
reset_2 = Boolean(reset_colider)
popgeo = PopulateGeometry(Geometry=guide_surface_3, Count=count_2, Seed=1)
gate_3 = StreamGate(Stream=popgeo, Gate=gate_2)  # -> Target0, Target1
gate_4 = StreamGate(Stream=guide_surface_2, Gate=gate_2)  # -> Target0, Target1
sc = SphereCollide(Points=gate_3.Target1, Radius=min_distance_2, Strength=1)
mesh = MeshBrep(
    Brep=gate_4.Target1,
    Settings={GridMaxCount=0, GridMinCount=16, JaggedSeams=False, MaxEdgeLength=0, MinEdgeLength=0.0001, MinTolerance=0, Refine=True, RefineAngle=0, RelativeTolerance=0.65, SimplePlanes=True, Tolerance=0})
onmesh = OnMesh(Points=gate_3.Target1, Mesh=mesh, Strength=1)
solver = Solver(GoalObjects=[sc, onmesh], Reset=reset_2, Threshold=1e-15, Tolerance=0.01, On=True)  # -> I, V, O
dam = DataDam(DataA=solver.V, BufferDelay=10000000, BufferMode=0)
distance_check_solution = Point(dam)
simple_solution = Point(gate_3.Target0)

scale_2 = Scale(Geometry=move_3.Geometry, Center=Z, Factor=graph_2)  # -> Geometry, Transform
scale_3 = Scale(Geometry=move_4.Geometry, Center=Z, Factor=graph_2)  # -> Geometry, Transform
rotate = Rotate(Geometry=scale_2.Geometry, Angle=degrees(remap_3.Clipped), Plane=Z)  # -> Geometry, Transform
int_2 = Integer(sampling_ratio)
rotate_2 = Rotate(Geometry=scale_3.Geometry, Angle=degrees(remap_3.Clipped), Plane=Z)  # -> Geometry, Transform
loft = Loft(Curves=rotate.Geometry, Options={Adjust=False, Closed=False, LoftEnds=0, LoftSimp=0, LoftType=0, Rebuild=10, Refit=0.01})
item_2 = ListItem(List=rotate.Geometry, Index=0, Wrap=True)
item_3 = ListItem(List=rotate.Geometry, Index=int_2, Wrap=True)
loft_2 = Loft(
    Curves=rotate_2.Geometry,
    Options={Adjust=False, Closed=False, LoftEnds=0, LoftSimp=0, LoftType=0, Rebuild=10, Refit=0.01})
int_3 = Integer(sampling_ratio)
item_4 = ListItem(List=rotate_2.Geometry, Index=0, Wrap=True)
item_5 = ListItem(List=rotate_2.Geometry, Index=int_3, Wrap=True)
rulesrf_2 = RuledSurface(CurveA=item_2, CurveB=item_4)
rulesrf_3 = RuledSurface(CurveA=item_3, CurveB=item_5)
merge = Merge(Data1=loft, Data2=rulesrf_2, Data3=loft_2, Data4=rulesrf_3)
join = BrepJoin(Breps=merge)  # -> Breps, Closed

# ----
# Solution Selector
distance_check_solution_2 = Point(dam)
simple_solution_2 = Point(gate_3.Target0)
gate_5 = Integer(list)
filter = StreamFilter(Gate=gate_5, Stream0=simple_solution_2, Stream1=distance_check_solution_2)
points = Point(filter)

geo = Geometry(<brep referenced from the Rhino model>)
Z_2 = UnitZ(Factor=1)
max_shift_3 = Number(max_shift)
vertical_vector = Vector(Z_2)
shift_seef_2 = Integer(shift_seed)
points_2 = Point(points)
lng = ListLength(List=points_2)
dom_4 = ConstructDomain(DomainStart=0, DomainEnd=max_shift_3)
random = Random(Range=Domain(0, 1), Number=lng, Seed=shift_seef_2)
remap_4 = RemapNumbers(Value=random, Source=Domain(0, 1), Target=dom_4)  # -> Mapped, Clipped
amp_2 = Amplitude(Vector=vertical_vector, Amplitude=remap_4.Clipped)
celling_height = Slider(8000, range=10..10000)
move_5 = Move(Geometry=points_2, Motion=amp_2)  # -> Geometry, Transform
number_slider_2 = Slider(0.319, range=0..0.5)
xy = XYPlane(Origin=Point(0, 0, 0))
xy_2 = XYPlane(Origin=Point(0, 0, 0))
pln = Plane(xy)
pln_2 = Plane(xy_2)
geo_2 = Geometry(geo)
pl_origin = PlaneOrigin(Base=pln, Origin=move_5.Geometry)
pt = ConstructPoint(XCoordinate=0, YCoordinate=0, ZCoordinate=celling_height)
crv = Curve(control_curve)
dom_5 = ConstructDomain(DomainStart=expr("1-X", number_slider_2), DomainEnd=expr("1+x", number_slider_2))
xy_3 = XYPlane(Origin=pt)
crv_cp = CurveClosestPoint(Point=pl_origin, Curve=crv)  # -> Point, Parameter, Distance
orient = Orient(Geometry=geo_2, Source=pln_2, Target=pl_origin)  # -> Geometry, Transform
Z_3 = UnitZ(Factor=1)
graph_3 = GraphMapper(crv_cp.Parameter, x0=0, x1=1, y0=0, y1=1, container_name="Gaussian", factor=0.2, mean=0.4832579792, sdev=0.2369813919)
lng_2 = ListLength(List=graph_3)
random_2 = Random(Range=dom_5, Number=lng_2, Seed=2)
element_length_2 = Number(lenght)
vec = Vector(Z_3)
celling_plane = Plane(xy_3)
multiplication_2 = Multiplication(A=graph_3, B=random_2)
pt_2 = Point(move_5.Geometry)
amp_3 = Amplitude(Vector=vec, Amplitude=element_length_2)
bnd = Bounds(Numbers=multiplication_2)
merge_2 = Merge(
    Data1=0,
    Data2=Slider(0.23, range=0..1),
    Data3=Slider(0.43, range=0..1),
    Data4=Slider(0.68, range=0..1),
    Data5=Slider(0.92, range=0..1),
    Data7=1)
move_6 = Move(Geometry=pt_2, Motion=amp_3)  # -> Geometry, Transform
remap_5 = RemapNumbers(Value=multiplication_2, Source=bnd, Target=Domain(0, 1))  # -> Mapped, Clipped
sort_2 = SortList(Keys=merge_2)  # -> Keys, ValuesA
bang = ExplodeTree(Data=graft(sort_2.Keys))  # -> Branch0, Branch1, Branch2, Branch3, Branch4, Branch5
expression = Expression(x=remap_5.Mapped, Expression="floor(x*4)")
gradient = Gradient(
    LowerLimit=0,
    UpperLimit=1,
    Parameter=remap_5.Mapped,
    stops=[0: RGB(234, 38, 0), 0.25: RGB(234, 126, 0), 0.5: RGB(254, 244, 84), 0.75: RGB(173, 203, 249), 1: RGB(75, 107, 169)])
celling_plane_2 = Plane(xy_3)
project = Project(Geometry=pt_2, Plane=celling_plane)  # -> Geometry, Transform
equals = Equality(FirstNumber=0, SecondNumber=expression)  # -> Equality, Inequality
equals_2 = Equality(FirstNumber=2, SecondNumber=expression)  # -> Equality, Inequality
equals_3 = Equality(FirstNumber=1, SecondNumber=expression)  # -> Equality, Inequality
larger = LargerThan(FirstNumber=expression, SecondNumber=3)  # -> LargerThan, OrEqualTo
between = PythonScript(items=orient.Geometry, gates=graph_3, low=bang.Branch0, high=bang.Branch1)  # -> out, result; inputs items: list, gates: list
# ---------- between: Python ----------
result = []
for index, item in enumerate(items):
    if (gates[index] < high) and (gates[index] > low):
        result.append(item)
# ---------- end between ----------
num_3 = Number(Slider(0.7, range=0..100))
con = DelaunayEdges(Points=project.Geometry, Plane=celling_plane_2)  # -> Connectivity, Edges
ln = Line(StartPoint=move_6.Geometry, EndPoint=project.Geometry)
cull = CullPattern(List=orient.Geometry, CullPattern=equals_2.Equality)
cull_2 = CullPattern(List=orient.Geometry, CullPattern=larger.OrEqualTo)
cull_3 = CullPattern(List=orient.Geometry, CullPattern=equals_3.Equality)
cull_4 = CullPattern(List=orient.Geometry, CullPattern=equals.Equality)
len_2 = Length(Curve=con.Edges)
pipe = Pipe(Curve=ln, Radius=num_3, Caps=1)  # -> flatten(Pipe)
larger_2 = LargerThan(FirstNumber=Slider(9.6, range=0..15), SecondNumber=len_2)  # -> LargerThan, OrEqualTo
geo_3 = Geometry(cull_4)
geo_4 = Geometry(cull_3)
geo_5 = Geometry(cull)
geo_6 = Geometry(cull_2)
geo_7 = Geometry(pipe)
preview = CustomPreview(Geometry=geo_3, Shader=ColourSwatch(SwatchColor=RGB(214, 214, 214)))
preview_2 = CustomPreview(Geometry=geo_4, Shader=ColourSwatch(SwatchColor=RGB(255, 8, 8)))
preview_3 = CustomPreview(Geometry=geo_5, Shader=ColourSwatch(SwatchColor=RGB(101, 237, 17)))
preview_4 = CustomPreview(Geometry=geo_6, Shader=ColourSwatch(SwatchColor=RGB(9, 133, 222)))
preview_5 = CustomPreview(Geometry=geo_7, Shader=ColourSwatch(SwatchColor=RGB(166, 166, 166)))
cull_5 = CullPattern(List=con.Edges, CullPattern=larger_2.LargerThan)
preview_6 = CustomPreview(Geometry=orient.Geometry, Shader=gradient)
