# Grasshopper definition Bakery.gh (Grasshopper 0.9.76)
# Copyright:  All rights reserved
# plug-ins: EleFront

element_1_layer = ValueList({"Mess", "Source", "Guide", "Bake"}, selected="Bake")
element_2_layer = ValueList({"Mess", "Source", "Guide", "Bake"}, selected="Guide")
cir = Circle(Plane=PlaneXY(0, 0, 0), Radius=1)
cir_2 = Circle(Plane=PlaneXY(-5.103147315, 3.448702295, 0), Radius=1)
panel = Panel("Jmeno")
bake_all = BakeAllElefront()
button = Button()
entwine = Entwine(Branch00=cir, Branch01=cir_2, FlattenInputs=True)
entwine_2 = Entwine(Branch00=element_1_layer, Branch01=element_2_layer, FlattenInputs=True)

# ----
# Bakery
timer = Timer(TimerInterval=1000, Target=time)
overwrite = Boolean(Toggle(True))
layers = Text()
data = Data()
time = Time("Now")
panel_2 = Panel(time)
attributes = DefineObjectAttributes(Name=time, Layer=layers)
filter = StreamFilter(Gate=overwrite, Stream1="Bakery")
bake = BakeObjects(Geometry=data, Attributes=attributes, BakeName=filter, Bake=False)
panel_3 = Panel(bake)
