# Grasshopper definition Lasvit_180924+.gh (Grasshopper 0.9.76)
# plug-ins: Kangaroo2 Components

# ----
# INPUT
# Colider Control
# Element Control
space_around_element = Slider(20.2, range=0..380)
shift_seed = DigitScroller(Scroller_Digits=12, Scroller_Prefix="Shift Seed", Scroller_Radix=11, Scroller_Value=55)
random_dithering_seed = DigitScroller(Scroller_Digits=12, Scroller_Prefix="Random Dithering Seed", Scroller_Radix=11, Scroller_Value=25)
# Dithering Control
random_dithering_ratio = Slider(0.319, range=0..0.5)
base_circel_radius = Slider(24, range=0..50)
outer_filet_radius = Slider(11, range=0..200)
thicknes_ratio = Slider(0.28, range=0..1)
element_lenght = Slider(1, range=1..2000)
circles_radius = Slider(1.1, range=0..4)
string_thickness = Slider(0.7, range=0..100)
# Macro Control
area_width_max = Slider(62, range=1..4000)
sampling_ratio = Slider(17, range=1..20)
twist_angle = Slider(112, range=0..360)
curve_sampling = Slider(48, range=3..80)
element_count = Slider(500, range=10..500)
celing_height = Slider(530, range=10..3000)
max_shift = Slider(57, range=0..500)
number_slider = Slider(3, range=2..5)
reset_colider = Button()
list = ValueList({"Simple": 0, "Distance Check": 1}, selected="Distance Check")
control_curve = Curve(reparameterize(<curve referenced from the Rhino model>))

# ----
# Lukáš Matěja (C) 2018
# 
# for: LASVIT
# 
# TroubleShotting:
# Check if DataDam ins not blocking your solution.
# 
# Element Control is more visual then numerical
# 
# It's highly recomanded to not update Element when connected to Macro solution
control_curves = Curve(reparameterize(graft([<curve referenced from the Rhino model> x2])))
solver_on = BooleanToggle(False)
base_circle_radius = Number(base_circel_radius)
circle_count = Integer(number_slider)
outer_filet_radius_2 = Number(outer_filet_radius)
min_distance = Number(space_around_element)
circles_radius_2 = Number(circles_radius)
sampling = Number(curve_sampling)
string_thickness_2 = Number(string_thickness)
element_length = Number(element_lenght)
max_shift_2 = Number(max_shift)
solver_on_2 = Boolean(solver_on)
thicknes_ratio_2 = Number(thicknes_ratio)
shift_seef = Integer(shift_seed)
reset = Boolean(reset_colider)
twist_angle_2 = Number(twist_angle)
curve = Curve(control_curve)
max_width = Number(area_width_max)
sampling_2 = Integer(sampling_ratio)
gate = Integer(list)
randomize_ratio = Number(random_dithering_ratio)
randomize_seed = Integer(random_dithering_seed)
celing_height_2 = Number(celing_height)
curves = Curve(control_curves)
count = Integer(element_count)

# ----
# Guide Surface from Curve
# Area width graph >>>
sampling_3 = Number(curve_sampling)
max_width_2 = Number(area_width_max)
curve_2 = Curve(curves)
range = Range(Domain=Domain(0, 1), Steps=expr("x-1", sampling_3))
dom = ConstructDomain(DomainStart=0, DomainEnd=max_width_2)
hframe = HorizontalFrame(Curve=curve_2, Parameter=range)
graph = GraphMapper(
    range,
    x0=0,
    x1=1,
    y0=0,
    y1=1,
    container_name="Bezier",
    cpx=[0, 0.3127830923, 0.7630519867, 1],
    cpy=[0.06797724962, 1, 0.9969968796, 0.05610460043])
deplane = DeconstructPlane(Plane=hframe)  # -> Origin, XAxis, YAxis, ZAxis
remap = RemapNumbers(Value=graph, Source=Domain(0, 1), Target=dom)  # -> Mapped, Clipped
amp = Amplitude(Vector=deplane.YAxis, Amplitude=remap.Clipped)
move = Move(Geometry=deplane.Origin, Motion=expr("-x", amp))  # -> Geometry, Transform
move_2 = Move(Geometry=deplane.Origin, Motion=amp)  # -> Geometry, Transform
intcrv = Interpolate(Vertices=move.Geometry, Degree=3, Periodic=False, KnotStyle=1)  # -> Curve, Length, Domain
intcrv_2 = Interpolate(Vertices=move_2.Geometry, Degree=3, Periodic=False, KnotStyle=1)  # -> Curve, Length, Domain
rulesrf = RuledSurface(CurveA=intcrv_2.Curve, CurveB=intcrv.Curve)
guide_surface = Surface(rulesrf)

# ----
# Base Curve Generation
base_circle_radius_2 = Number(base_circel_radius)
circles_radius_3 = Number(circles_radius)
circle_count_2 = Integer(number_slider)
range_2 = Range(Domain=Domain(0, 1), Steps=circle_count_2)
cir = Circle(Plane=PlaneXY(0, 0, 0), Radius=base_circle_radius_2)
multiplication = Multiplication(A=base_circle_radius_2, B=circles_radius_3)
eval = EvaluateCurve(Curve=reparameterize(cir), Parameter=range_2)  # -> Point, Tangent, Angle
cir_2 = Circle(Plane=eval.Point, Radius=multiplication)
runion = RegionUnion(Curves=cir_2)
base_curve = Curve(runion)

pt = ConstructPoint(XCoordinate=0, YCoordinate=0, ZCoordinate=0)
pt_2 = ConstructPoint(XCoordinate=0, YCoordinate=0, ZCoordinate=0)
pt_3 = ConstructPoint(XCoordinate=0, YCoordinate=0, ZCoordinate=0)
celing_height_3 = Number(celing_height)
pt_4 = ConstructPoint(XCoordinate=0, YCoordinate=0, ZCoordinate=celing_height_3)
xy = XYPlane(Origin=pt_4)

# ----
# Double output controll
base_curve_2 = Curve(base_curve)
len = Length(Curve=base_curve_2)
sort = SortList(Keys=len, ValuesA=base_curve_2)  # -> Keys, ValuesA
item = ListItem(List=reverse(sort.ValuesA), Index=0, Wrap=True)
base_curve_3 = Curve(item)

pln = Plane(xy)
project = Project(Geometry=intcrv.Curve, Plane=pln)  # -> Geometry, Transform
project_2 = Project(Geometry=intcrv_2.Curve, Plane=pln)  # -> Geometry, Transform

# ----
# Filleting
outer_filet_radius_3 = Number(outer_filet_radius)
base_curve_4 = Curve(item)
fillet = Fillet(Curve=base_curve_4, Radius=outer_filet_radius_3)
base_curve_5 = Curve(fillet)

end = EndPoints(Curve=project.Geometry)  # -> Start, End
end_2 = EndPoints(Curve=project_2.Geometry)  # -> Start, End
xy_2 = XYPlane(Origin=Point(0, 0, 0))
crv = Curve([<curve referenced from the Rhino model> x2])

# ----
# Inner wall
# I've used scale because offset will take time without significant difference
thicknes_ratio_3 = Number(thicknes_ratio)
base_curve_6 = Curve(base_curve_5)
scale = Scale(Geometry=base_curve_6, Center=Point(0, 0, 0), Factor=expr("1-x", thicknes_ratio_3))  # -> Geometry, Transform
inner_base_curve = Curve(scale.Geometry)

disc = Discontinuity(Curve=crv, Level=1)  # -> Points, Parameters
ln = Line(StartPoint=end_2.Start, EndPoint=end.Start)
ln_2 = Line(StartPoint=end_2.End, EndPoint=end.End)
ms = MagnetSnap(Points=disc.Points, Range=50, Strength=10)  # -> flatten(S)
join = JoinCurves(Curves=[project_2.Geometry, ln, ln_2, project.Geometry], Preserve=False)
grab = Grab(On=crv, Strength=1, Range=3)  # -> Grab, Anchors
num = Number(Slider(1.466, range=0..5))
solver = Solver(Reset=Button(), Threshold=1e-15, Tolerance=0.01, On=True)  # -> I, V, O
Z = UnitZ(Factor=1)
offset_l = OffsetLoose(Curve=join, Distance=num, Plane=pln)
runion_2 = RegionUnion(Curves=flatten(offset_l), Plane=pln)

# ----
# Doubleclick Me!
# Thickness graph >>>
element_length_2 = Number(element_lenght)
vertical_direction = Vector(Z)
twist_angle_3 = Number(twist_angle)
sampling_4 = Integer(sampling_ratio)
base_curve_7 = Curve(base_curve_5)
dom_2 = ConstructDomain(DomainStart=0, DomainEnd=twist_angle_3)
dom_3 = ConstructDomain(DomainStart=0, DomainEnd=element_length_2)
range_3 = Range(Domain=Domain(0, 1), Steps=sampling_4)
# It will be more correct to use Remap too but, this is good enough and and easier to modify
thickness_graph = GraphMapper(
    range_3,
    x0=0,
    x1=1,
    y0=0,
    y1=1,
    container_name="Bezier",
    cpx=[0, 0.3817386329, 0.6643322706, 1],
    cpy=[0.9568119049, 0.6924642324, 0.4988933802, 0.2669668794])
remap_2 = RemapNumbers(Value=range_3, Source=Domain(0, 1), Target=dom_3)  # -> Mapped, Clipped
Z_2 = UnitZ(Factor=remap_2.Clipped)
amp_2 = Amplitude(Vector=vertical_direction, Amplitude=remap_2.Clipped)
pt_5 = ConstructPoint(XCoordinate=0, YCoordinate=0, ZCoordinate=remap_2.Mapped)
move_3 = Move(Geometry=base_curve_7, Motion=amp_2)  # -> Geometry, Transform
scale_2 = Scale(Geometry=move_3.Geometry, Center=pt_5, Factor=thickness_graph)  # -> Geometry, Transform
center_points = Point(pt_5)
profiles = Curve(scale_2.Geometry)

boundary = BoundarySurfaces(Edges=runion_2)

# ----
# Point Population & Solver
# DATA DAM >>>>>
guide_surface_2 = Brep(boundary)
guide_surface_3 = Surface(guide_surface_2)
min_distance_2 = Number(space_around_element)
solver_on_3 = Boolean(solver_on_2)
reset_2 = Boolean(reset_colider)
gate_2 = Integer(list)
count_2 = Integer(element_count)
popgeo = PopulateGeometry(Geometry=guide_surface_3, Count=count_2, Seed=1)
gate_3 = StreamGate(Stream=popgeo, Gate=gate_2)  # -> Target0, Target1
gate_4 = StreamGate(Stream=guide_surface_2, Gate=gate_2)  # -> Target0, Target1
mesh = MeshBrep(
    Brep=gate_4.Target1,
    Settings={GridMaxCount=0, GridMinCount=16, JaggedSeams=False, MaxEdgeLength=0, MinEdgeLength=0.0001, MinTolerance=0, Refine=True, RefineAngle=0, RelativeTolerance=0.65, SimplePlanes=True, Tolerance=0})
sc = SphereCollide(Points=gate_3.Target1, Radius=min_distance_2, Strength=1)
onmesh = OnMesh(Points=gate_3.Target1, Mesh=mesh, Strength=1000)
solver_2 = Solver(GoalObjects=[sc, onmesh], Reset=reset_2, Threshold=1e-15, Tolerance=0.01, On=solver_on_3)  # -> I, V, O
dam = DataDam(DataA=solver_2.V, BufferDelay=10000000, BufferMode=0)
distance_check_solution = Point(dam)
simple_solution = Point(gate_3.Target0)

data = Data(solver_2.V)
random = Random(Range=Domain(0, 1), Number=count_2, Seed=2)
line = Line([Line((-0.4961778085, 8.830255736, 0), (5.695592808, 15.30347047, 0)), Line((7.759516347, 3.107558651, 0), (11.04303107, 11.83232634, 0))])
len_2 = Length(Curve=line)
eval_2 = EvaluateCurve(Curve=line, Parameter=0)  # -> Point, Tangent, Angle
merge = Merge(Data1=Slider(6.3, range=0.5..20), Data2=Slider(3.1, range=0.5..20))
direction = Direction(Line=line, Direction=eval_2.Tangent, Strength=1)
grab_2 = Grab(On=True, Strength=1, Range=10)  # -> Grab, Anchors
length_line = LengthLine(Line=line, Length=len_2, Strength=10)
collider = Collider(Objects=line, Radii=merge, Strength=1)
show = Show(G=line)
normalized_values = Number(range_3)

# ----
# Solution Selector
distance_check_solution_2 = Point(dam)
simple_solution_2 = Point(simple_solution)
gate_5 = Integer(list)
filter = StreamFilter(Gate=gate_5, Stream0=simple_solution_2, Stream1=distance_check_solution_2)
points = Point(filter)

Z_3 = UnitZ(Factor=-1)
solver_3 = Solver(
    GoalObjects=[show, grab_2.Grab, collider, length_line, direction],
    Reset=Button(),
    Threshold=1e-15,
    Tolerance=0.001,
    On=Toggle(True))  # -> I, V, O
guide_surface_4 = Surface(rulesrf)
vec = Vector(Z_3)
xy_3 = XYPlane(Origin=Point(0, 0, 0))
project_3 = ProjectPoint(Point=points, Direction=vec, Geometry=guide_surface_4)  # -> Point, Index
pipe = Pipe(Curve=solver_3.O, Radius=merge, Caps=2)
guide_surface_5 = Surface(rulesrf)
srf_cp = SurfaceClosestPoint(Point=project_3.Point, Surface=guide_surface_5)  # -> Point, UVPoint, Distance
evalsrf = EvaluateSurface(Surface=guide_surface_5, Point=srf_cp.UVPoint)  # -> Point, Normal, Frame
planes = Plane(evalsrf.Frame)

# ----
# Hight shiffting
Z_4 = UnitZ(Factor=1)
xy_4 = XYPlane(Origin=Point(0, 0, 0))
horzontal_plane = Plane(xy_4)
max_shift_3 = Number(max_shift)
shift_seef_2 = Integer(shift_seed)
vertical_vector = Vector(Z_4)
points_2 = Point(project_3.Point)
lng = ListLength(List=planes)
dom_4 = ConstructDomain(DomainStart=0, DomainEnd=max_shift_3)
random_2 = Random(Range=Domain(0, 1), Number=lng, Seed=shift_seef_2)
remap_3 = RemapNumbers(Value=random_2, Source=Domain(0, 1), Target=dom_4)  # -> Mapped, Clipped
amp_3 = Amplitude(Vector=vertical_vector, Amplitude=remap_3.Clipped)
move_4 = Move(Geometry=planes, Motion=amp_3)  # -> Geometry, Transform
pl_origin = PlaneOrigin(Base=horzontal_plane, Origin=move_4.Geometry)  # disabled
planes_for_elements = Plane(move_4.Geometry)

# ----
# Celing plane
celing_height_4 = Number(celing_height)
pt_6 = ConstructPoint(XCoordinate=0, YCoordinate=0, ZCoordinate=celing_height_4)
xy_5 = XYPlane(Origin=pt_6)
celing_plane = Plane(xy_5)

Z_5 = UnitZ(Factor=1)

string_thickness_3 = Number(string_thickness)
element_points = Point(planes_for_elements)
celling_plane = Plane(xy_5)
# TODO - Reduce overlaps
vertical_direction_2 = Vector(Z_5)
element_height = Number(element_lenght)
amp_4 = Amplitude(Vector=vertical_direction_2, Amplitude=element_height)
project_4 = Project(Geometry=element_points, Plane=celling_plane)  # -> Geometry, Transform
move_5 = Move(Geometry=element_points, Motion=amp_4)  # -> Geometry, Transform
capping = ValueList({"None": 0, "Flat": 1, "Round": 2}, selected="Flat")
ln_3 = Line(StartPoint=move_5.Geometry, EndPoint=project_4.Geometry)
pipe_2 = Pipe(Curve=ln_3, Radius=string_thickness_3, Caps=capping)  # -> flatten(Pipe)
sring_geo = Brep(pipe_2)

element = Surface(<surface referenced from the Rhino model>)
element_adjusted = Geometry(element)
xy_6 = XYPlane(Origin=Point(0, 0, 0))

# ----
# WIP
celling_plane_2 = Plane(xy_5)
con = DelaunayEdges(Points=project_4.Geometry, Plane=celling_plane_2)  # -> Connectivity, Edges
len_3 = Length(Curve=con.Edges)
larger = LargerThan(FirstNumber=Slider(9.6, range=0..15), SecondNumber=len_3)  # -> LargerThan, OrEqualTo
cull = CullPattern(List=con.Edges, CullPattern=larger.LargerThan)

# ----
# Group Selector evaluate
target_plane = Plane(planes_for_elements)
crv_2 = Curve(control_curve)
crv_cp = CurveClosestPoint(Point=target_plane, Curve=crv_2)  # -> Point, Parameter, Distance
graph_2 = GraphMapper(crv_cp.Parameter, x0=0, x1=1, y0=0, y1=1, container_name="Gaussian", factor=0.2, mean=0.4832579792, sdev=0.2369813919)
selector_regular = Number(graph_2)

# ----
# Orienting Elements
constructin_plane_of_element = Plane(xy_6)
target_plane_2 = Plane(planes_for_elements)
element_geo = Geometry(element_adjusted)
orient = Orient(Geometry=element_geo, Source=constructin_plane_of_element, Target=target_plane_2)  # -> Geometry, Transform
oriented_elements = Brep(orient.Geometry)

# ----
# Random Dithering
selector_regular_2 = Number(selector_regular)
randomize_ratio_2 = Number(random_dithering_ratio)
randomize_seed_2 = Integer(random_dithering_seed)
lng_2 = ListLength(List=selector_regular_2)
dom_5 = ConstructDomain(DomainStart=expr("1-X", randomize_ratio_2), DomainEnd=expr("1+x", randomize_ratio_2))
random_3 = Random(Range=dom_5, Number=lng_2, Seed=randomize_seed_2)
multiplication_2 = Multiplication(A=selector_regular_2, B=random_3)
bnd = Bounds(Numbers=multiplication_2)
remap_4 = RemapNumbers(Value=multiplication_2, Source=bnd, Target=Domain(0, 1))  # -> Mapped, Clipped
selector_dithered = Number(remap_4.Mapped)

# ----
# [TODO] Different dithering
selector_regular_3 = Number(selector_regular)

# ---- group: Grouping
# Grouping (4 groups)
selector_dithered_2 = Number(selector_dithered)
oriented_elements_2 = Brep(oriented_elements)
expression = Expression(x=selector_dithered_2, Expression="floor(x*4)")
larger_2 = LargerThan(FirstNumber=expression, SecondNumber=3)  # -> LargerThan, OrEqualTo
equals = Equality(FirstNumber=1, SecondNumber=expression)  # -> Equality, Inequality
equals_2 = Equality(FirstNumber=2, SecondNumber=expression)  # -> Equality, Inequality
equals_3 = Equality(FirstNumber=0, SecondNumber=expression)  # -> Equality, Inequality
cull_2 = CullPattern(List=oriented_elements_2, CullPattern=equals_2.Equality)
cull_3 = CullPattern(List=oriented_elements_2, CullPattern=equals_3.Equality)
cull_4 = CullPattern(List=oriented_elements_2, CullPattern=equals.Equality)
cull_5 = CullPattern(List=oriented_elements_2, CullPattern=larger_2.OrEqualTo)
group_1 = Geometry(cull_4)
group_0 = Geometry(cull_3)
group_2 = Geometry(cull_2)
group_3 = Geometry(cull_5)

# ----
# [WIP] Python way
number_slider_2 = Slider(0.23, range=0..1)
oriented_elements_3 = Brep(oriented_elements)
merge_2 = Merge(
    Data1=0,
    Data2=number_slider_2,
    Data3=Slider(0.43, range=0..1),
    Data4=Slider(0.68, range=0..1),
    Data5=Slider(0.92, range=0..1),
    Data7=1)
sort_2 = SortList(Keys=merge_2)  # -> Keys, ValuesA
bang = ExplodeTree(Data=graft(sort_2.Keys))  # -> Branch0, Branch1, Branch2, Branch3, Branch4, Branch5

# ----
# Colors
string_color = ColourSwatch(SwatchColor=RGB(166, 166, 166))
group_0_2 = ColourSwatch(SwatchColor=RGB(214, 214, 214))
group_1_2 = ColourSwatch(SwatchColor=RGB(255, 8, 8))
group_2_2 = ColourSwatch(SwatchColor=RGB(101, 237, 17))
group_3_2 = ColourSwatch(SwatchColor=RGB(9, 133, 222))

# ----
# Preview
# Group 3
geo = Geometry(cull_5)
col = Colour(group_3_2)
preview = CustomPreview(Geometry=geo, Shader=col)

# ----
# Preview
# Group 0
col_2 = Colour(group_0_2)
geo_2 = Geometry(cull_3)
preview_2 = CustomPreview(Geometry=geo_2, Shader=col_2)

# ----
# Preview
# Group 2
geo_3 = Geometry(cull_2)
col_3 = Colour(group_2_2)
preview_3 = CustomPreview(Geometry=geo_3, Shader=col_3)

# ----
# Preview
# Strings
color = Colour(string_color)
strings = Geometry(sring_geo)
preview_4 = CustomPreview(Geometry=strings, Shader=color)

# ----
# Preview
# Group 1
col_4 = Colour(group_1_2)
geo_4 = Geometry(cull_4)
preview_5 = CustomPreview(Geometry=geo_4, Shader=col_4)

# ----
# Test Preview
oriented_elements_4 = Brep(oriented_elements)
selector_dithered_3 = Number(selector_dithered)
gradient = Gradient(
    LowerLimit=0,
    UpperLimit=1,
    Parameter=selector_dithered_3,
    stops=[0: RGB(234, 38, 0), 0.25: RGB(234, 126, 0), 0.5: RGB(254, 244, 84), 0.75: RGB(173, 203, 249), 1: RGB(75, 107, 169)])
preview_6 = CustomPreview(Geometry=oriented_elements_4, Shader=gradient)

# ----
# Inner wall paralel creating
inner_base_curve_2 = Curve(scale.Geometry)
move_6 = Move(Geometry=inner_base_curve_2, Motion=Z_2)  # -> Geometry, Transform
scale_3 = Scale(Geometry=move_6.Geometry, Center=Z_2, Factor=thickness_graph)  # -> Geometry, Transform

# ----
# Element twisting
horzontal_plane_2 = Plane(xy_3)
twist_angle_4 = Number(twist_angle)
normalized_values_2 = Number(normalized_values)
center_points_2 = Point(center_points)
profiles_2 = Curve(profiles)
pl_origin_2 = PlaneOrigin(Base=horzontal_plane_2, Origin=center_points_2)

dom_6 = ConstructDomain(DomainStart=0, DomainEnd=twist_angle_4)

remap_5 = RemapNumbers(Value=normalized_values_2, Source=Domain(0, 1), Target=dom_6)  # -> Mapped, Clipped
rotate = Rotate(Geometry=profiles_2, Angle=degrees(remap_5.Clipped), Plane=pl_origin_2)  # -> Geometry, Transform
twisting_profiles = Curve(rotate.Geometry)

rotate_2 = Rotate(Geometry=scale_3.Geometry, Angle=degrees(remap_5.Clipped), Plane=pl_origin_2)  # -> Geometry, Transform

# ----
# Surfacing
twisting_inner_profiles = Curve(rotate_2.Geometry)
twisting_profiles_2 = Curve(twisting_profiles)
sampling_5 = Integer(sampling_ratio)
sampling_6 = Integer(sampling_ratio)
item_2 = ListItem(List=twisting_profiles_2, Index=sampling_5, Wrap=True)
item_3 = ListItem(List=twisting_profiles_2, Index=0, Wrap=True)
loft = Loft(
    Curves=twisting_profiles_2,
    Options={Adjust=False, Closed=False, LoftEnds=0, LoftSimp=0, LoftType=0, Rebuild=10, Refit=0.01})
loft_2 = Loft(
    Curves=twisting_inner_profiles,
    Options={Adjust=False, Closed=False, LoftEnds=0, LoftSimp=0, LoftType=0, Rebuild=10, Refit=0.01})
item_4 = ListItem(List=twisting_inner_profiles, Index=0, Wrap=True)
item_5 = ListItem(List=twisting_inner_profiles, Index=sampling_6, Wrap=True)
rulesrf_2 = RuledSurface(CurveA=item_2, CurveB=item_5)
rulesrf_3 = RuledSurface(CurveA=item_3, CurveB=item_4)
merge_3 = Merge(Data1=loft, Data2=rulesrf_3, Data3=loft_2, Data4=rulesrf_2)
join_2 = BrepJoin(Breps=merge_3)  # -> Breps, Closed
finished_element = Geometry(join_2.Breps)
