# Grasshopper definition SanSouci_190205.gh (Grasshopper 1.0.7)
# plug-ins: EleFront, Kangaroo2 Components

# ----
# INPUT
# Colider Control
# Element Control
space_around_element = Slider(27.9, range=0..380)  # disabled
shift_seed = DigitScroller(Scroller_Digits=12, Scroller_Prefix="Shift Seed", Scroller_Radix=11, Scroller_Value=55)  # disabled
random_dithering_seed = DigitScroller(Scroller_Digits=12, Scroller_Prefix="Random Dithering Seed", Scroller_Radix=11, Scroller_Value=25)  # disabled
# Dithering Control
random_dithering_ratio = Slider(0.319, range=0..0.5)  # disabled
base_circel_radius = Slider(24, range=0..50)  # disabled
outer_filet_radius = Slider(11, range=0..200)  # disabled
thicknes_ratio = Slider(0.28, range=0..1)  # disabled
element_lenght = Slider(1, range=1..2000)  # disabled
circles_radius = Slider(1.1, range=0..4)  # disabled
string_thickness = Slider(0.7, range=0..100)  # disabled
# Macro Control
area_width_max = Slider(128, range=1..400)  # disabled
sampling_ratio = Slider(17, range=1..20)  # disabled
twist_angle = Slider(112, range=0..360)  # disabled
curve_sampling = Slider(48, range=3..80)  # disabled
element_count = Slider(687, range=10..1000)  # disabled
celing_height = Slider(530, range=10..3000)  # disabled
max_shift = Slider(57, range=0..500)  # disabled
number_slider = Slider(3, range=2..5)  # disabled
reset_colider = Button()  # disabled
list = ValueList({"Simple": 0, "Distance Check": 1}, selected="Distance Check")  # disabled
control_curve = Curve(reparameterize(<curve referenced from the Rhino model>))  # disabled

# ----
# Lukáš Matěja (C) 2018
# 
# for: LASVIT
# 
# TroubleShotting:
# Check if DataDam ins not blocking your solution.
# 
# Element Control is more visual then numerical
# 
# It's highly recomanded to not update Element when connected to Macro solution
control_curves = Curve(reparameterize(graft([<curve referenced from the Rhino model> x2])))  # disabled
solver_on = BooleanToggle(False)  # disabled
element_count_2 = GenePool(Decimals=0, Maximum=300, Minimum=2, Value=[300, 200, 120, 30])  # disabled
# Have to be lower then Min Width
safety_offset = Slider(7.9, range=0..30)  # disabled
population_seed = DigitScroller(Scroller_Digits=12, Scroller_Prefix="Population Seed", Scroller_Radix=11, Scroller_Value=40)  # disabled
keep_in_borders = Slider(842, range=0..1000)  # disabled
# Population Control
preview_random_population = Button()  # disabled
preview_solver_circles = Button()  # disabled
# Area Control
preview_area = Button()  # disabled
preview_final = Button()  # disabled
base_circle_radius = Number(base_circel_radius)  # disabled
circle_count = Integer(number_slider)  # disabled
min_distance = Number(space_around_element)  # disabled
outer_filet_radius_2 = Number(outer_filet_radius)  # disabled
solver_on_2 = BooleanToggle(False)  # disabled
circles_radius_2 = Number(circles_radius)  # disabled
sampling = Number(curve_sampling)  # disabled
solver_on_3 = Boolean(solver_on)  # disabled
string_thickness_2 = Number(string_thickness)  # disabled
reset = Boolean(reset_colider)  # disabled
element_length = Number(element_lenght)  # disabled
max_shift_2 = Number(max_shift)  # disabled
shift_seef = Integer(shift_seed)  # disabled
thicknes_ratio_2 = Number(thicknes_ratio)  # disabled
curve = Curve(control_curve)  # disabled
twist_angle_2 = Number(twist_angle)  # disabled
gate = Integer(list)  # disabled
max_width = Number(area_width_max)  # disabled
sampling_2 = Integer(sampling_ratio)  # disabled
curves = Curve(control_curves)  # disabled
count = Integer(element_count)  # disabled
randomize_seed = Integer(random_dithering_seed)  # disabled
celing_height_2 = Number(celing_height)  # disabled
randomize_ratio = Number(random_dithering_ratio)  # disabled
count_list = Integer(element_count_2)  # disabled
solver_on_4 = Boolean(solver_on_2)  # disabled
keep_force = Number(keep_in_borders)  # disabled
safety_offset_2 = Number(safety_offset)  # disabled
population_seed_2 = Integer(population_seed)  # disabled

# ----
# Guide Surface from Curve
# Area width graph >>>
sampling_3 = Number(curve_sampling)  # disabled
max_width_2 = Number(area_width_max)  # disabled
curve_2 = Curve(curves)  # disabled
range = Range(Domain=Domain(0, 1), Steps=expr("x-1", sampling_3))  # disabled
dom = ConstructDomain(DomainStart=0, DomainEnd=max_width_2)  # disabled
hframe = HorizontalFrame(Curve=curve_2, Parameter=range)  # disabled
graph = GraphMapper(
    range,
    x0=0,
    x1=1,
    y0=0,
    y1=1,
    container_name="Bezier",
    cpx=[0, 0.3127830923, 0.7630519867, 1],
    cpy=[0.06797724962, 1, 0.9969968796, 0.05610460043])  # disabled
deplane = DeconstructPlane(Plane=hframe)  # -> Origin, XAxis, YAxis, ZAxis; disabled
remap = RemapNumbers(Value=graph, Source=Domain(0, 1), Target=dom)  # -> Mapped, Clipped; disabled
amp = Amplitude(Vector=deplane.YAxis, Amplitude=remap.Clipped)  # disabled
move = Move(Geometry=deplane.Origin, Motion=expr("-x", amp))  # -> Geometry, Transform; disabled
move_2 = Move(Geometry=deplane.Origin, Motion=amp)  # -> Geometry, Transform; disabled
intcrv = Interpolate(Vertices=move.Geometry, Degree=3, Periodic=False, KnotStyle=1)  # -> Curve, Length, Domain; disabled
intcrv_2 = Interpolate(Vertices=move_2.Geometry, Degree=3, Periodic=False, KnotStyle=1)  # -> Curve, Length, Domain; disabled
rulesrf = RuledSurface(CurveA=intcrv_2.Curve, CurveB=intcrv.Curve)  # disabled
guide_surface = Surface(rulesrf)  # disabled

# ----
# Base Curve Generation
base_circle_radius_2 = Number(base_circel_radius)  # disabled
circles_radius_3 = Number(circles_radius)  # disabled
circle_count_2 = Integer(number_slider)  # disabled
range_2 = Range(Domain=Domain(0, 1), Steps=circle_count_2)  # disabled
cir = Circle(Plane=PlaneXY(0, 0, 0), Radius=base_circle_radius_2)  # disabled
multiplication = Multiplication(A=base_circle_radius_2, B=circles_radius_3)  # disabled
eval = EvaluateCurve(Curve=reparameterize(cir), Parameter=range_2)  # -> Point, Tangent, Angle; disabled
cir_2 = Circle(Plane=eval.Point, Radius=multiplication)  # disabled
runion = RegionUnion(Curves=cir_2)  # disabled
base_curve = Curve(runion)  # disabled

pt = ConstructPoint(XCoordinate=0, YCoordinate=0, ZCoordinate=0)
pt_2 = ConstructPoint(XCoordinate=0, YCoordinate=0, ZCoordinate=0)  # disabled
pt_3 = ConstructPoint(XCoordinate=0, YCoordinate=0, ZCoordinate=0)  # disabled
celing_height_3 = Number(celing_height)  # disabled
pt_4 = ConstructPoint(XCoordinate=0, YCoordinate=0, ZCoordinate=celing_height_3)  # disabled
xy = XYPlane(Origin=pt_4)  # disabled

# ----
# Double output controll
base_curve_2 = Curve(base_curve)  # disabled
len = Length(Curve=base_curve_2)  # disabled
sort = SortList(Keys=len, ValuesA=base_curve_2)  # -> Keys, ValuesA; disabled
item = ListItem(List=reverse(sort.ValuesA), Index=0, Wrap=True)  # disabled
base_curve_3 = Curve(item)  # disabled

pln = Plane(xy)  # disabled
project = Project(Geometry=intcrv.Curve, Plane=pln)  # -> Geometry, Transform; disabled
project_2 = Project(Geometry=intcrv_2.Curve, Plane=pln)  # -> Geometry, Transform; disabled

# ----
# Filleting
outer_filet_radius_3 = Number(outer_filet_radius)  # disabled
base_curve_4 = Curve(item)  # disabled
fillet = Fillet(Curve=base_curve_4, Radius=outer_filet_radius_3)  # disabled
base_curve_5 = Curve(fillet)  # disabled

end = EndPoints(Curve=project.Geometry)  # -> Start, End; disabled
end_2 = EndPoints(Curve=project_2.Geometry)  # -> Start, End; disabled
xy_2 = XYPlane(Origin=Point(0, 0, 0))  # disabled
crv = Curve([<curve referenced from the Rhino model> x2])  # disabled
number_slider_2 = Slider(1.466, range=0..5)  # disabled
disc = Discontinuity(Curve=crv, Level=1)  # -> Points, Parameters; disabled

# ----
# Inner wall
# I've used scale because offset will take time without significant difference
thicknes_ratio_3 = Number(thicknes_ratio)  # disabled
base_curve_6 = Curve(base_curve_5)  # disabled
scale = Scale(Geometry=base_curve_6, Center=Point(0, 0, 0), Factor=expr("1-x", thicknes_ratio_3))  # -> Geometry, Transform; disabled
inner_base_curve = Curve(scale.Geometry)  # disabled

button = Button()  # disabled
ln = Line(StartPoint=end_2.Start, EndPoint=end.Start)  # disabled
ln_2 = Line(StartPoint=end_2.End, EndPoint=end.End)  # disabled
ms = MagnetSnap(Points=disc.Points, Range=50, Strength=10)  # -> flatten(S); disabled
join = JoinCurves(Curves=[project_2.Geometry, ln, ln_2, project.Geometry], Preserve=False)  # disabled
grab = Grab(On=crv, Strength=1, Range=3)  # -> Grab, Anchors; disabled
num = Number(number_slider_2)  # disabled

# ----
# Celing
celing_height_4 = Number(celing_height)  # disabled
# Parametrické definování roviny stropu
pt_5 = ConstructPoint(XCoordinate=0, YCoordinate=0, ZCoordinate=celing_height_4)  # disabled
xy_3 = XYPlane(Origin=pt_5)  # disabled
celing = Plane(xy_3)  # disabled

solver = Solver(Reset=button, Threshold=1e-15, Tolerance=0.01, On=True)  # -> I, V, O; disabled
Z = UnitZ(Factor=1)  # disabled
offset_l = OffsetLoose(Curve=join, Distance=num, Plane=pln)  # disabled
runion_2 = RegionUnion(Curves=flatten(offset_l), Plane=pln)  # disabled

# ----
# Doubleclick Me!
# Thickness graph >>>
element_length_2 = Number(element_lenght)  # disabled
vertical_direction = Vector(Z)  # disabled
twist_angle_3 = Number(twist_angle)  # disabled
sampling_4 = Integer(sampling_ratio)  # disabled
base_curve_7 = Curve(base_curve_5)  # disabled
dom_2 = ConstructDomain(DomainStart=0, DomainEnd=twist_angle_3)  # disabled
dom_3 = ConstructDomain(DomainStart=0, DomainEnd=element_length_2)  # disabled
range_3 = Range(Domain=Domain(0, 1), Steps=sampling_4)  # disabled
# It will be more correct to use Remap too but, this is good enough and and easier to modify
thickness_graph = GraphMapper(
    range_3,
    x0=0,
    x1=1,
    y0=0,
    y1=1,
    container_name="Bezier",
    cpx=[0, 0.3817386329, 0.6643322706, 1],
    cpy=[0.9568119049, 0.6924642324, 0.4988933802, 0.2669668794])  # disabled
remap_2 = RemapNumbers(Value=range_3, Source=Domain(0, 1), Target=dom_3)  # -> Mapped, Clipped; disabled
Z_2 = UnitZ(Factor=remap_2.Clipped)  # disabled
amp_2 = Amplitude(Vector=vertical_direction, Amplitude=remap_2.Clipped)  # disabled
pt_6 = ConstructPoint(XCoordinate=0, YCoordinate=0, ZCoordinate=remap_2.Mapped)  # disabled
move_3 = Move(Geometry=base_curve_7, Motion=amp_2)  # -> Geometry, Transform; disabled
scale_2 = Scale(Geometry=move_3.Geometry, Center=pt_6, Factor=thickness_graph)  # -> Geometry, Transform; disabled
center_points = Point(pt_6)  # disabled
profiles = Curve(scale_2.Geometry)  # disabled

boundary = BoundarySurfaces(Edges=runion_2)  # disabled

# ----
# Point Population & Solver
# DATA DAM >>>>>
guide_surface_2 = Brep(boundary)  # disabled
guide_surface_3 = Surface(guide_surface_2)  # disabled
min_distance_2 = Number(space_around_element)  # disabled
solver_on_5 = Boolean(solver_on_3)  # disabled
reset_2 = Boolean(reset_colider)  # disabled
gate_2 = Integer(list)  # disabled
count_2 = Integer(element_count)  # disabled
popgeo = PopulateGeometry(Geometry=guide_surface_3, Count=count_2, Seed=1)  # disabled
gate_3 = StreamGate(Stream=popgeo, Gate=gate_2)  # -> Target0, Target1; disabled
gate_4 = StreamGate(Stream=guide_surface_2, Gate=gate_2)  # -> Target0, Target1; disabled
mesh = MeshBrep(
    Brep=gate_4.Target1,
    Settings={GridMaxCount=0, GridMinCount=16, JaggedSeams=False, MaxEdgeLength=0, MinEdgeLength=0.0001, MinTolerance=0, Refine=True, RefineAngle=0, RelativeTolerance=0.65, SimplePlanes=True, Tolerance=0})  # disabled
sc = SphereCollide(Points=gate_3.Target1, Radius=min_distance_2, Strength=1)  # disabled
onmesh = OnMesh(Points=gate_3.Target1, Mesh=mesh, Strength=1000)  # disabled
solver_2 = Solver(GoalObjects=[sc, onmesh], Reset=reset_2, Threshold=1e-15, Tolerance=0.01, On=solver_on_5)  # -> I, V, O; disabled
dam = DataDam(DataA=solver_2.V, BufferDelay=10000000, BufferMode=0)  # disabled
distance_check_solution = Point(dam)  # disabled
simple_solution = Point(gate_3.Target0)  # disabled

data = Data(solver_2.V)  # disabled
normalized_values = Number(range_3)  # disabled

# ----
# Solution Selector
distance_check_solution_2 = Point(dam)  # disabled
simple_solution_2 = Point(simple_solution)  # disabled
gate_5 = Integer(list)  # disabled
filter = StreamFilter(Gate=gate_5, Stream0=simple_solution_2, Stream1=distance_check_solution_2)  # disabled
points = Point(filter)  # disabled

Z_3 = UnitZ(Factor=-1)  # disabled
guide_surface_4 = Surface(rulesrf)  # disabled
vec = Vector(Z_3)  # disabled
xy_4 = XYPlane(Origin=Point(0, 0, 0))  # disabled
guide_surface_5 = Surface(rulesrf)  # disabled
number_slider_3 = Slider(31.2, range=0..100)  # disabled

# ----
# Celing plane
celing_height_5 = Number(celing_height)  # disabled
pt_7 = ConstructPoint(XCoordinate=0, YCoordinate=0, ZCoordinate=celing_height_5)  # disabled
xy_5 = XYPlane(Origin=pt_7)  # disabled
celing_plane = Plane(xy_5)  # disabled

num_2 = Number(number_slider_3)  # disabled
Z_4 = UnitZ(Factor=1)  # disabled
mesh_2 = Mesh(mesh)  # disabled
srf = Surface(mesh)  # disabled
number_slider_4 = Slider(1.8, range=0.5..20)  # disabled
number_slider_5 = Slider(10.3, range=0.5..20)  # disabled
dom_4 = ConstructDomain(DomainStart=number_slider_5, DomainEnd=number_slider_4)  # disabled
merge = Merge(Data1=number_slider_5, Data2=number_slider_4)  # disabled
button_2 = Button()  # disabled
grab_2 = Grab(On=True, Strength=1, Range=10)  # -> Grab, Anchors; disabled
xy_6 = XYPlane(Origin=Point(0, 0, 0))  # disabled
element = Geometry(<brep referenced from the Rhino model>)  # disabled
toggle = BooleanToggle(False)  # disabled
Z_5 = UnitZ(Factor=-1)  # disabled

# ----
# Colors
string_color = ColourSwatch(SwatchColor=RGB(166, 166, 166))  # disabled
group_0 = ColourSwatch(SwatchColor=RGB(214, 214, 214))  # disabled
group_1 = ColourSwatch(SwatchColor=RGB(255, 8, 8))  # disabled
group_2 = ColourSwatch(SwatchColor=RGB(101, 237, 17))  # disabled
group_3 = ColourSwatch(SwatchColor=RGB(9, 133, 222))  # disabled

# ----
# INPUT
# Macro Control
# Area width modulation
space_around_element_2 = Slider(10.6, range=0..30)  # disabled
area_width_min = Slider(32, range=1..400)  # disabled
area_width_max_2 = Slider(84, range=1..400)  # disabled
string_thickness_3 = Slider(0.11, range=0..5)  # disabled
curve_sampling_2 = Slider(48, range=3..80)  # disabled
celing_height_6 = Slider(530, range=10..3000)  # disabled
reset_colider_2 = Button()  # disabled
control_curves_2 = Curve(reparameterize(graft([<curve referenced from the Rhino model> x2])))  # disabled
bake = Button()  # disabled
elements = Geometry([<brep referenced from the Rhino model> x4])  # disabled

elements_2 = Geometry(elements)  # disabled
celing_height_7 = Number(celing_height_6)  # disabled
curves_2 = Curve(control_curves_2)  # disabled
reset_3 = Boolean(reset_colider_2)  # disabled
string_thickness_4 = Number(string_thickness_3)  # disabled
sampling_5 = Number(curve_sampling_2)  # disabled
min_width = Number(area_width_min)  # disabled
max_width_3 = Number(area_width_max_2)  # disabled
space_around = Number(space_around_element_2)  # disabled
bake_2 = Boolean(bake)  # disabled

# ----
# Elements key atributes
elements_3 = Data(elements)  # disabled
bbox = BoundingBox(Content=elements_3, Plane=PlaneXY(0, 0, 0))  # -> Box, Box_2; disabled
box = EvaluateBox(Box=bbox.Box, UParameter=0.5, VParameter=0.5, WParameter=1)  # -> Plane, Point, Include; disabled
boxprop = BoxProperties(Box=bbox.Box)  # -> Center, Diagonal, Area, Volume, Degeneracy; disabled
pdecon = Deconstruct(Point=boxprop.Diagonal)  # -> XComponent, YComponent, ZComponent; disabled
diameter = Expression(diameter=pdecon.XComponent, Expression="diameter/2")  # disabled
sort_2 = SortList(Keys=diameter, ValuesA=elements_3)  # -> Keys, ValuesA; disabled
radiuses_sorted = Number(sort_2.Keys)  # disabled
elements_sorted = Data(sort_2.ValuesA)  # disabled
anchor_planes = Plane(box.Plane)  # disabled

radius_list = Number(radiuses_sorted)  # disabled

# ----
# Radius list by element count
count_list_2 = Integer(element_count_2)  # disabled
radius_list_2 = Number(radius_list)  # disabled
lng = ListLength(List=radius_list_2)  # disabled
# V závislosti na počtu jednotlivých elementů jsou vytvořeny stejně četné listy průměrů a indentifikátorů.
series = Series(Start=0, Step=1, Count=lng)  # disabled
ma = MassAddition(Input=count_list_2)  # -> Result, PartialResults; disabled
stack = StackData(Data=radius_list_2, Stack=count_list_2)  # disabled
stack_2 = StackData(Data=series, Stack=count_list_2)  # disabled
radius_indexes = Number(stack_2)  # disabled
total_count = Number(ma.Result)  # disabled
radiuses = Number(stack)  # disabled

elements_count = Panel(total_count)  # disabled
radius_indexes_2 = Number(radius_indexes)  # disabled
radiuses_2 = Number(radiuses)  # disabled
total_count_2 = Number(ma.Result)  # disabled

# ----
# OUTPUT
preview_nothing = Button()

# ----
# << SOLUTION | PREVIEW >>
or = GateOr(A=preview_nothing, B=bake)

# ----
# Remember
merge_2 = Merge(Data1=preview_area, Data2=preview_random_population, Data3=preview_solver_circles, Data4=preview_final, Data5=or)  # disabled
button_list = Integer(merge_2)  # disabled
rememeber = PythonScript(selector=button_list)  # -> last; inputs selector: list of Boolean; disabled
# ---------- rememeber: Python ----------
class Storage:
    
    def __init__(self):
        self.data = 0
    def set(self,data):
        self.data = data
    def get(self):
        return self.data

try:
    s
except:
    s = Storage()

for i,item in enumerate(selector):
    if item:
        s.set(i)

last = s.get()
# ---------- end rememeber ----------
selector = Panel(rememeber)  # disabled
selector_2 = Integer(rememeber)  # disabled

# ----
# Guide Surface from Curve
sampling_6 = Number(curve_sampling_2)  # disabled
max_width_4 = Number(area_width_max_2)  # disabled
# Celé rozmístění elementů je kontrolováno libovolným počtem křivek v jejich okolí jsou následně umísťované elementy. Průběh šířky této oblasti lze snadno modulovat Graph Mapperem
min_width_2 = Number(area_width_min)  # disabled
curve_3 = Curve(curves_2)  # disabled
range_4 = Range(Domain=Domain(0, 1), Steps=expr("x-1", sampling_6))  # disabled
dom_5 = ConstructDomain(DomainStart=min_width_2, DomainEnd=max_width_4)  # disabled
hframe_2 = HorizontalFrame(Curve=curve_3, Parameter=range_4)  # disabled
graph_mapper_1 = Number(range_4)  # disabled
deplane_2 = DeconstructPlane(Plane=hframe_2)  # -> Origin, XAxis, YAxis, ZAxis; disabled

graph_2 = GraphMapper(
    graph_mapper_1,
    x0=0,
    x1=1,
    y0=0,
    y1=1,
    container_name="Bezier",
    cpx=[0, 0.290780127, 0.6879432797, 1],
    cpy=[0.06797724962, 1, 1, 0.05610460043])  # disabled

graph_mapper_1_2 = Number(graph_2)  # disabled

graph_mapper_1_3 = Number(graph_2)  # disabled

bnd = Bounds(Numbers=graph_mapper_1_3)  # disabled

remap_3 = RemapNumbers(Value=graph_mapper_1_3, Source=bnd, Target=dom_5)  # -> Mapped, Clipped; disabled
amp_3 = Amplitude(Vector=deplane_2.YAxis, Amplitude=remap_3.Clipped)  # disabled
move_4 = Move(Geometry=deplane_2.Origin, Motion=expr("-x", amp_3))  # -> Geometry, Transform; disabled
move_5 = Move(Geometry=deplane_2.Origin, Motion=amp_3)  # -> Geometry, Transform; disabled
intcrv_3 = Interpolate(Vertices=move_4.Geometry, Degree=3, Periodic=False, KnotStyle=1)  # -> Curve, Length, Domain; disabled
intcrv_4 = Interpolate(Vertices=move_5.Geometry, Degree=3, Periodic=False, KnotStyle=1)  # -> Curve, Length, Domain; disabled
rulesrf_2 = RuledSurface(CurveA=intcrv_4.Curve, CurveB=intcrv_3.Curve)  # disabled
guide_surface_6 = Surface(rulesrf_2)  # disabled

# ----
# Celing Area
celing_2 = Plane(celing)  # disabled
# Na stropě vytyčena oblast kde se budou vyskytovat závěsy elementů. Tato oblast je následně použita pro první generaci rozmístění jednotlivých elementů.
guide_surface_7 = Surface(rulesrf_2)  # disabled
safety_offset_3 = Number(safety_offset_2)  # disabled
project_3 = Project(Geometry=guide_surface_7, Plane=celing_2)  # -> Geometry, Transform; disabled
offset_l_2 = OffsetLoose(Curve=project_3.Geometry, Distance=safety_offset_3, Plane=celing_2)  # disabled
runion_3 = RegionUnion(Curves=flatten(offset_l_2), Plane=celing_2)  # disabled
boundary_2 = BoundarySurfaces(Edges=runion_3)  # disabled
celing_area = Surface(boundary_2)  # disabled

# ----
# Point Population
population_seed_3 = Integer(population_seed)  # disabled
# První generace poloh pro umístění elmentů (v rovině stropu)
guide_surface_8 = Surface(celing_area)  # disabled
count_3 = Integer(total_count)  # disabled
popgeo_2 = PopulateGeometry(Geometry=guide_surface_8, Count=count_3, Seed=population_seed_3)  # disabled
simple_solution_3 = Point(popgeo_2)  # disabled

# ----
# Sorf points from edges
celing_area_2 = Surface(boundary_2)  # disabled
simple_solution_4 = Point(simple_solution_3)  # disabled
radius_indexes_3 = Number(radius_indexes)  # disabled
# Pro další úpravu je třeba setřídit body tak, aby největší elementy byly umístěny uprostřed a malé ke krajům
edges = BrepEdges(Brep=celing_area_2)  # -> Naked, Interior, NonManifold; disabled
join_2 = JoinCurves(Curves=edges.Naked, Preserve=False)  # disabled
crv_cp = CurveClosestPoint(Point=graft(simple_solution_4), Curve=join_2)  # -> Point, Parameter, Distance; disabled
sort_3 = SortList(Keys=crv_cp.Distance)  # -> Keys, ValuesA; disabled
item_2 = ListItem(List=sort_3.Keys, Index=0, Wrap=True)  # disabled
sort_4 = SortList(Keys=flatten(item_2), ValuesA=simple_solution_4, ValuesB=radius_indexes_3)  # -> Keys, ValuesA, ValuesB; disabled
sorted_points = Point(sort_4.ValuesA)  # disabled
celing_edges = Curve(join_2)  # disabled
radius_indexes_sorted = Number(sort_4.ValuesB)  # disabled

# ----
# Inner wall paralel creating
inner_base_curve_2 = Curve(scale.Geometry)  # disabled
move_6 = Move(Geometry=inner_base_curve_2, Motion=Z_2)  # -> Geometry, Transform; disabled
scale_3 = Scale(Geometry=move_6.Geometry, Center=Z_2, Factor=thickness_graph)  # -> Geometry, Transform; disabled

# ----
# Element twisting
horzontal_plane = Plane(xy_4)  # disabled
twist_angle_4 = Number(twist_angle)  # disabled
normalized_values_2 = Number(normalized_values)  # disabled
center_points_2 = Point(center_points)  # disabled
profiles_2 = Curve(profiles)  # disabled
pl_origin = PlaneOrigin(Base=horzontal_plane, Origin=center_points_2)  # disabled

dom_6 = ConstructDomain(DomainStart=0, DomainEnd=twist_angle_4)  # disabled

remap_4 = RemapNumbers(Value=normalized_values_2, Source=Domain(0, 1), Target=dom_6)  # -> Mapped, Clipped; disabled
rotate = Rotate(Geometry=profiles_2, Angle=degrees(remap_4.Clipped), Plane=pl_origin)  # -> Geometry, Transform; disabled
twisting_profiles = Curve(rotate.Geometry)  # disabled

rotate_2 = Rotate(Geometry=scale_3.Geometry, Angle=degrees(remap_4.Clipped), Plane=pl_origin)  # -> Geometry, Transform; disabled

# ----
# Surfacing
twisting_inner_profiles = Curve(rotate_2.Geometry)  # disabled
twisting_profiles_2 = Curve(twisting_profiles)  # disabled
sampling_7 = Integer(sampling_ratio)  # disabled
sampling_8 = Integer(sampling_ratio)  # disabled
item_3 = ListItem(List=twisting_profiles_2, Index=sampling_7, Wrap=True)  # disabled
item_4 = ListItem(List=twisting_profiles_2, Index=0, Wrap=True)  # disabled
loft = Loft(
    Curves=twisting_profiles_2,
    Options={Adjust=False, Closed=False, LoftEnds=0, LoftSimp=0, LoftType=0, Rebuild=10, Refit=0.01})  # disabled
loft_2 = Loft(
    Curves=twisting_inner_profiles,
    Options={Adjust=False, Closed=False, LoftEnds=0, LoftSimp=0, LoftType=0, Rebuild=10, Refit=0.01})  # disabled
item_5 = ListItem(List=twisting_inner_profiles, Index=0, Wrap=True)  # disabled
item_6 = ListItem(List=twisting_inner_profiles, Index=sampling_8, Wrap=True)  # disabled
rulesrf_3 = RuledSurface(CurveA=item_3, CurveB=item_6)  # disabled
rulesrf_4 = RuledSurface(CurveA=item_4, CurveB=item_5)  # disabled
merge_3 = Merge(Data1=loft, Data2=rulesrf_4, Data3=loft_2, Data4=rulesrf_3)  # disabled
join_3 = BrepJoin(Breps=merge_3)  # -> Breps, Closed; disabled
finished_element = Geometry(join_3.Breps)  # disabled

# ----
# Hight shiffting
Z_6 = UnitZ(Factor=1)  # disabled
xy_7 = XYPlane(Origin=Point(0, 0, 0))  # disabled
horzontal_plane_2 = Plane(xy_7)  # disabled
max_shift_3 = Number(max_shift)  # disabled
shift_seef_2 = Integer(shift_seed)  # disabled
vertical_vector = Vector(Z_6)  # disabled
dom_7 = ConstructDomain(DomainStart=0, DomainEnd=max_shift_3)  # disabled

# ----
# Pro další úpravu je třeba setřídit body tak, aby největší elementy byly umístěny uprostřed a malé ke krajům
# Circle Packing
guide_surface_9 = Brep(celing_area)  # disabled
sorted_points_2 = Point(sorted_points)  # disabled
radiuses_3 = Number(radiuses)  # disabled
keep_force_2 = Number(keep_in_borders)  # disabled
space_around_2 = Number(space_around_element_2)  # disabled
solver_on_6 = Boolean(solver_on_2)  # disabled
celing_3 = Plane(xy_3)  # disabled
reset_4 = Boolean(reset_colider_2)  # disabled
mesh_3 = MeshBrep(
    Brep=guide_surface_9,
    Settings={GridMaxCount=0, GridMinCount=16, JaggedSeams=False, MaxEdgeLength=0, MinEdgeLength=0.0001, MinTolerance=0, Refine=True, RefineAngle=0, RelativeTolerance=0.65, SimplePlanes=True, Tolerance=0})  # disabled
addition = Addition(A=radiuses_3, B=space_around_2)  # disabled
number_slider_6 = Slider(0.95, range=0..5)  # disabled
collider = Collider(Objects=sorted_points_2, Radii=addition, Strength=5)  # disabled
onmesh_2 = OnMesh(Points=sorted_points_2, Mesh=mesh_3, Strength=keep_force_2)  # disabled
ms_2 = MagnetSnap(Points=sorted_points_2, Range=40, Strength=number_slider_6)  # disabled
merge_4 = Merge(Data1=onmesh_2, Data2=collider, Data3=ms_2)  # disabled
dam_2 = DataDam(DataA=merge_4, BufferDelay=10000000, BufferMode=1)  # disabled
solver_3 = Solver(GoalObjects=dam_2, Reset=reset_4, Threshold=1e-15, Tolerance=0.01, On=solver_on_6)  # -> I, V, O; disabled
pl_origin_2 = PlaneOrigin(Base=celing_3, Origin=solver_3.V)  # disabled
adjusted_points = Point(solver_3.V)  # disabled
cir_3 = Circle(Plane=pl_origin_2, Radius=radiuses_3)  # disabled

# ----
# Points after solver stop
dam_3 = DataDam(DataAdjustedPoints=adjusted_points, BufferDelay=10000000, BufferMode=0)  # disabled

adjusted_points_2 = Point(dam_3)  # disabled

string_thickness_5 = Number(string_thickness)  # disabled
celling_plane = Plane(xy_5)  # disabled
# TODO - Reduce overlaps
vertical_direction_2 = Vector(Z_4)  # disabled
element_height = Number(element_lenght)  # disabled
amp_4 = Amplitude(Vector=vertical_direction_2, Amplitude=element_height)  # disabled
capping = ValueList({"None": 0, "Flat": 1, "Round": 2}, selected="Flat")  # disabled

# ----
# WIP
celling_plane_2 = Plane(xy_5)  # disabled
number_slider_7 = Slider(9.6, range=0..15)  # disabled

# ----
# Orienting Elements
constructin_plane_of_element = Plane(xy_6)  # disabled
element_geo = Geometry(element)  # disabled

# ----
# Group Selector evaluate
crv_2 = Curve(control_curve)  # disabled

# ----
# Elements positioning
points_2 = Point()  # disabled
verical_vector = Vector(Z_5)  # disabled
elements_sorted_2 = Data(sort_2.ValuesA)  # disabled
radius_indexes_4 = Number(radius_indexes)  # disabled
anchor_planes_2 = Plane(anchor_planes)  # disabled
guide_surface_10 = Surface(guide_surface_6)  # disabled
project_4 = ProjectPoint(Point=points_2, Direction=verical_vector, Geometry=guide_surface_10)  # -> Point, Index; disabled
item_7 = ListItem(List=elements_sorted_2, Index=radius_indexes_4, Wrap=True)  # disabled
xy_8 = XYPlane(Origin=project_4.Point)  # disabled
element_planes = Plane(xy_8)  # disabled

dam_4 = DataDam(DataElementPlanes=element_planes, BufferDelay=10000000, BufferMode=0)  # disabled

element_planes_2 = Plane(dam_4)  # disabled
orient = Orient(Geometry=item_7, Source=anchor_planes_2, Target=element_planes_2)  # -> Geometry, Transform; disabled
oriented_elements = Data(orient.Geometry)  # disabled

# ----
# Tree Harvester
radius_indexes_5 = Number(radius_indexes)  # disabled
data_2 = Data(oriented_elements)  # disabled
panel = Panel("2")  # disabled
panel_2 = Panel("1")  # disabled
panel_3 = Panel("0")  # disabled
panel_4 = Panel("3")  # disabled
equals = Equality(FirstNumber=radius_indexes_5, SecondNumber=panel)  # -> Equality, Inequality; disabled
equals_2 = Equality(FirstNumber=radius_indexes_5, SecondNumber=panel_2)  # -> Equality, Inequality; disabled
equals_3 = Equality(FirstNumber=radius_indexes_5, SecondNumber=panel_3)  # -> Equality, Inequality; disabled
equals_4 = Equality(FirstNumber=radius_indexes_5, SecondNumber=panel_4)  # -> Equality, Inequality; disabled
cull = CullPattern(List=data_2, CullPattern=equals.Equality)  # disabled
cull_2 = CullPattern(List=data_2, CullPattern=equals_2.Equality)  # disabled
cull_3 = CullPattern(List=data_2, CullPattern=equals_3.Equality)  # disabled
cull_4 = CullPattern(List=data_2, CullPattern=equals_4.Equality)  # disabled

# ----
# Random Dithering
randomize_ratio_2 = Number(random_dithering_ratio)  # disabled
randomize_seed_2 = Integer(random_dithering_seed)  # disabled
dom_8 = ConstructDomain(DomainStart=expr("1-X", randomize_ratio_2), DomainEnd=expr("1+x", randomize_ratio_2))  # disabled

# ----
# [WIP] Python way
number_slider_8 = Slider(0.23, range=0..1)  # disabled
number_slider_9 = Slider(0.43, range=0..1)  # disabled
number_slider_10 = Slider(0.68, range=0..1)  # disabled
number_slider_11 = Slider(0.92, range=0..1)  # disabled
merge_5 = Merge(Data1=0, Data2=number_slider_8, Data3=number_slider_9, Data4=number_slider_10, Data5=number_slider_11, Data7=1)  # disabled
sort_5 = SortList(Keys=merge_5)  # -> Keys, ValuesA; disabled
bang = ExplodeTree(Data=graft(sort_5.Keys))  # -> Branch0, Branch1, Branch2, Branch3, Branch4, Branch5; disabled

# ----
# Wire maker
string_thickness_6 = Number(string_thickness_3)  # disabled
surface_points = Point(xy_8)  # disabled
celing_points = Point(adjusted_points_2)  # disabled
ln_3 = Line(StartPoint=surface_points, EndPoint=celing_points)  # disabled
path_mapper = PathMapper(ln_3, source="{A;B;C;D}(i)", target="{i}")  # disabled
len_2 = Length(Curve=path_mapper)  # disabled
sort_6 = SortList(Keys=len_2, ValuesA=path_mapper)  # -> Keys, ValuesA; disabled
lng_2 = ListLength(List=sort_6.ValuesA)  # disabled
item_8 = ListItem(List=sort_6.ValuesA, Index=expr("x-1", lng_2), Wrap=True)  # disabled
string_curves = Curve(item_8)  # disabled

dam_5 = DataDam(DataStringCurves=string_curves, BufferDelay=10000000, BufferMode=0)  # disabled

string_curves_2 = Curve(dam_5)  # disabled
pipe = Pipe(Curve=string_curves_2, Radius=string_thickness_6, Caps=0)  # disabled

string_geo = Geometry(pipe)  # disabled
string_geo_2 = Geometry(pipe)  # disabled

# ----
# Bakery
data_3 = Data(flatten(string_geo_2))  # disabled
data_4 = Data(flatten(cull_3))  # disabled
data_5 = Data(flatten(cull_4))  # disabled
data_6 = Data(flatten(cull_2))  # disabled
data_7 = Data(flatten(cull))  # disabled
list_2 = ValueList({"Výchozí", "Sketch", "Vrstva 02", "Vrstva 03", "Elements", "Vrstva 01", "Bake", "Bake2", "Bake2::0", "Bake2::1", "Bake2::2", "Bake2::3", "Bake2::wire"}, selected="Bake2::1")  # disabled
list_3 = ValueList({"Výchozí", "Sketch", "Vrstva 02", "Vrstva 03", "Elements", "Vrstva 01", "Bake", "Bake2", "Bake2::0", "Bake2::1", "Bake2::2", "Bake2::3", "Bake2::wire"}, selected="Bake2::2")  # disabled
list_4 = ValueList({"Výchozí", "Sketch", "Vrstva 02", "Vrstva 03", "Elements", "Vrstva 01", "Bake", "Bake2", "Bake2::0", "Bake2::1", "Bake2::2", "Bake2::3", "Bake2::wire"}, selected="Bake2::0")  # disabled
list_5 = ValueList({"Výchozí", "Sketch", "Vrstva 02", "Vrstva 03", "Elements", "Vrstva 01", "Bake", "Bake2", "Bake2::0", "Bake2::1", "Bake2::2", "Bake2::3", "Bake2::wire"}, selected="Bake2::3")  # disabled
list_6 = ValueList({"Výchozí", "Sketch", "Vrstva 02", "Vrstva 03", "Elements", "Vrstva 01", "Bake", "Bake2", "Bake2::0", "Bake2::1", "Bake2::2", "Bake2::3", "Bake2::wire"}, selected="Bake2::wire")  # disabled
overwrite = BooleanToggle(True)  # disabled
entwine = Entwine(Branch00=data_4, Branch01=data_6, Branch02=data_7, Branch03=data_5, Branch04=data_3, FlattenInputs=True)  # disabled
entwine_2 = Entwine(Branch00=list_4, Branch01=list_2, Branch02=list_3, Branch03=list_5, Branch04=list_6, FlattenInputs=True)  # disabled
panel_5 = Panel("Now")  # disabled
layers = Text(simplify(entwine_2))  # disabled
data_8 = Data(simplify(entwine))  # disabled
panel_6 = Panel("Bakery")  # disabled
bake_3 = Button()  # disabled
timer = Timer(TimerInterval=1000, Target=time)  # disabled
overwrite_2 = Boolean(overwrite)  # disabled
bake_4 = Boolean(bake)  # disabled
time = Time(panel_5)  # disabled
attributes = DefineObjectAttributes(Name=time, Layer=layers)  # disabled
filter_2 = StreamFilter(Gate=overwrite_2, Stream1=panel_6)  # disabled
panel_7 = Panel(time)  # disabled
or_2 = GateOr(A=bake_4, B=bake_3)  # disabled
bake_5 = BakeObjects(Geometry=data_8, Attributes=attributes, BakeName=filter_2, Bake=or_2)  # disabled
panel_8 = Panel(bake_5)  # disabled

# ----
# Geo Selector
entwine_3 = Entwine(
    Branch00=guide_surface_6,
    Branch01=simple_solution_3,
    Branch02=[cir_3, join_2],
    Branch03=[pipe, orient.Geometry],
    FlattenInputs=True)  # disabled
selector_3 = Integer(selector_2)  # disabled
panel_9 = Panel(selector_3)  # disabled
panel_10 = Panel("""0: Guide Surfaces
1: Radnom Population""")  # disabled
path_mapper_2 = PathMapper(entwine_3, source="{A;B}(i)", target="{B}")  # disabled
branch = TreeBranch(Tree=path_mapper_2, Path=selector_3, MaintainPaths=True)  # disabled
selected_geo = Geometry(branch)  # disabled

selected_geo_2 = Geometry(selected_geo)  # disabled

# ----
# Jednotlivé elementy jsou nahrány jako geometrie do grasshoperu. Zde jsou potom vypočítány základní atributy jako průměry a rozmístění elementů.
# Setup Bakery
selected_geo_3 = Geometry(selected_geo_2)  # disabled

# ----
# Preview
swatch = ColourSwatch(SwatchColor=RGB(255, 255, 255))  # disabled
selected_geo_4 = Geometry(selected_geo_2)  # disabled
shader = Shader(swatch)  # disabled
preview = CustomPreview(Geometry=selected_geo_4, Shader=shader)  # disabled

# ----
# Preview
# Group 3
col = Colour(group_3)  # disabled

# ----
# Preview
# Group 0
col_2 = Colour(group_0)  # disabled

# ----
# Preview
# Group 2
col_3 = Colour(group_2)  # disabled

# ----
# Preview
# Strings
color = Colour(string_color)  # disabled

# ----
# Preview
# Group 1
col_4 = Colour(group_1)  # disabled

# ----
# Test Preview
oriented_elements_2 = Brep()  # disabled

points_3 = Point(pt_8)  # disabled
project_5 = ProjectPoint(Point=points_3, Direction=vec, Geometry=guide_surface_4)  # -> Point, Index; disabled
srf_cp = SurfaceClosestPoint(Point=project_5.Point, Surface=guide_surface_5)  # -> Point, UVPoint, Distance; disabled
evalsrf = EvaluateSurface(Surface=guide_surface_5, Point=srf_cp.UVPoint)  # -> Point, Normal, Frame; disabled
planes = Plane(evalsrf.Frame)  # disabled

points_4 = Point(project_5.Point)  # disabled
lng_3 = ListLength(List=planes)  # disabled
random = Random(Range=Domain(0, 1), Number=lng_3, Seed=shift_seef_2)  # disabled
remap_5 = RemapNumbers(Value=random, Source=Domain(0, 1), Target=dom_7)  # -> Mapped, Clipped; disabled
amp_5 = Amplitude(Vector=vertical_vector, Amplitude=remap_5.Clipped)  # disabled
move_7 = Move(Geometry=planes, Motion=amp_5)  # -> Geometry, Transform; disabled
pl_origin_3 = PlaneOrigin(Base=horzontal_plane_2, Origin=move_7.Geometry)  # disabled
planes_for_elements = Plane(move_7.Geometry)  # disabled

deplane_3 = DeconstructPlane(Plane=evalsrf.Frame)  # -> Origin, XAxis, YAxis, ZAxis; disabled
line = LineSDL(Start=deplane_3.Origin, Direction=deplane_3.XAxis, Length=num_2)  # disabled
dam_6 = DataDam(DataA=line, BufferDelay=10000000, BufferMode=0)  # disabled
clean = CleanTree(RemoveNulls=True, RemoveInvalid=True, RemoveEmpty=True, Tree=dam_6)  # disabled

element_points = Point(planes_for_elements)  # disabled
project_6 = Project(Geometry=element_points, Plane=celling_plane)  # -> Geometry, Transform; disabled
move_8 = Move(Geometry=element_points, Motion=amp_4)  # -> Geometry, Transform; disabled
ln_4 = Line(StartPoint=move_8.Geometry, EndPoint=project_6.Geometry)  # disabled
pipe_2 = Pipe(Curve=ln_4, Radius=string_thickness_5, Caps=capping)  # -> flatten(Pipe); disabled
sring_geo = Brep(pipe_2)  # disabled

line_2 = Line(clean)  # disabled
lng_4 = ListLength(List=line_2)  # disabled
len_3 = Length(Curve=line_2)  # disabled
eval_2 = EvaluateCurve(Curve=line_2, Parameter=0)  # -> Point, Tangent, Angle; disabled
random_2 = Random(Range=dom_4, Number=lng_4, Seed=2)  # disabled
direction = Direction(Line=line_2, Direction=eval_2.Tangent, Strength=1)  # disabled
onmesh_3 = OnMesh(Points=eval_2.Point, Mesh=mesh_2, Strength=1)  # disabled
length_line = LengthLine(Line=line_2, Length=len_3, Strength=10)  # disabled
collider_2 = Collider(Objects=line_2, Radii=number_slider_5, Strength=1)  # disabled
show = Show(G=line_2)  # disabled

target_plane = Plane(planes_for_elements)  # disabled
crv_cp_2 = CurveClosestPoint(Point=target_plane, Curve=crv_2)  # -> Point, Parameter, Distance; disabled
graph_3 = GraphMapper(crv_cp_2.Parameter, x0=0, x1=1, y0=0, y1=1, container_name="Gaussian", factor=0.2, mean=0.4832579792, sdev=0.2369813919)  # disabled
selector_regular = Number(graph_3)  # disabled

target_plane_2 = Plane(planes_for_elements)  # disabled
orient_2 = Orient(Geometry=element_geo, Source=constructin_plane_of_element, Target=target_plane_2)  # -> Geometry, Transform; disabled
oriented_element = Geometry(orient_2.Geometry)  # disabled

con = DelaunayEdges(Points=project_6.Geometry, Plane=celling_plane_2)  # -> Connectivity, Edges; disabled
len_4 = Length(Curve=con.Edges)  # disabled
larger = LargerThan(FirstNumber=number_slider_7, SecondNumber=len_4)  # -> LargerThan, OrEqualTo; disabled
cull_5 = CullPattern(List=con.Edges, CullPattern=larger.LargerThan)  # disabled

merge_6 = Merge(Data1=direction, Data2=onmesh_3, Data3=length_line, Data4=grab_2.Grab, Data5=show, Data6=collider_2)  # disabled
solver_4 = Solver(GoalObjects=merge_6, Reset=button_2, Threshold=1e-15, Tolerance=0.001, On=toggle)  # -> I, V, O; disabled
dispatch = Dispatch(List=solver_4.V, DispatchPattern=[True, False])  # -> ListA, ListB; disabled
vec2pt = Vector2Pt(PointA=dispatch.ListA, PointB=dispatch.ListB, Unitize=True)  # -> Vector, Length; disabled
ln_5 = Line(StartPoint=dispatch.ListA, EndPoint=dispatch.ListB)  # disabled

selector_regular_2 = Number(selector_regular)  # disabled
lng_5 = ListLength(List=selector_regular_2)  # disabled
random_3 = Random(Range=dom_8, Number=lng_5, Seed=randomize_seed_2)  # disabled
multiplication_2 = Multiplication(A=selector_regular_2, B=random_3)  # disabled
bnd_2 = Bounds(Numbers=multiplication_2)  # disabled
remap_6 = RemapNumbers(Value=multiplication_2, Source=bnd_2, Target=Domain(0, 1))  # -> Mapped, Clipped; disabled
selector_dithered = Number(remap_6.Mapped)  # disabled

# ----
# [TODO] Different dithering
selector_regular_3 = Number(selector_regular)  # disabled

vec_2 = Vector(vec2pt.Vector)  # disabled
vec_3 = Vector(vec_2)  # disabled
align = AlignPlane(Plane=evalsrf.Frame, Direction=vec_3)  # -> Plane, Angle; disabled
deplane_4 = DeconstructPlane(Plane=align.Plane)  # -> Origin, XAxis, YAxis, ZAxis; disabled
line_3 = LineSDL(Start=align.Plane, Direction=deplane_4.XAxis, Length=num_2)  # disabled
pt_8 = Point(dispatch.ListA)  # disabled

# ---- group: Grouping
# Grouping (4 groups)
selector_dithered_2 = Number(selector_dithered)  # disabled
oriented_element_2 = Geometry(oriented_element)  # disabled
expression = Expression(x=selector_dithered_2, Expression="floor(x*4)")  # disabled
larger_2 = LargerThan(FirstNumber=expression, SecondNumber=3)  # -> LargerThan, OrEqualTo; disabled
equals_5 = Equality(FirstNumber=1, SecondNumber=expression)  # -> Equality, Inequality; disabled
equals_6 = Equality(FirstNumber=2, SecondNumber=expression)  # -> Equality, Inequality; disabled
equals_7 = Equality(FirstNumber=0, SecondNumber=expression)  # -> Equality, Inequality; disabled
cull_6 = CullPattern(List=oriented_element_2, CullPattern=equals_6.Equality)  # disabled
cull_7 = CullPattern(List=oriented_element_2, CullPattern=equals_7.Equality)  # disabled
cull_8 = CullPattern(List=oriented_element_2, CullPattern=equals_5.Equality)  # disabled
cull_9 = CullPattern(List=oriented_element_2, CullPattern=larger_2.OrEqualTo)  # disabled
group_0_2 = Geometry(cull_7)  # disabled
group_1_2 = Geometry(cull_8)  # disabled
group_2_2 = Geometry(cull_6)  # disabled
group_3_2 = Geometry(cull_9)  # disabled

# ----
oriented_element_3 = Geometry(oriented_element)  # disabled

geo = Geometry(cull_9)  # disabled
preview_2 = CustomPreview(Geometry=geo, Shader=col)  # disabled

geo_2 = Geometry(cull_6)  # disabled
preview_3 = CustomPreview(Geometry=geo_2, Shader=col_3)  # disabled

strings = Geometry(sring_geo)  # disabled
preview_4 = CustomPreview(Geometry=strings, Shader=color)  # disabled

geo_3 = Geometry(cull_7)  # disabled
preview_5 = CustomPreview(Geometry=geo_3, Shader=col_2)  # disabled

geo_4 = Geometry(cull_8)  # disabled
preview_6 = CustomPreview(Geometry=geo_4, Shader=col_4)  # disabled

oriented_element_4 = Geometry(oriented_element)  # disabled

selector_dithered_3 = Number(selector_dithered)  # disabled
gradient = Gradient(
    LowerLimit=0,
    UpperLimit=1,
    Parameter=selector_dithered_3,
    stops=[0: RGB(234, 38, 0), 0.25: RGB(234, 126, 0), 0.5: RGB(254, 244, 84), 0.75: RGB(173, 203, 249), 1: RGB(75, 107, 169)])  # disabled
preview_7 = CustomPreview(Geometry=oriented_element_4, Shader=gradient)  # disabled
