# Grasshopper definition SansSouci_01.gh (Grasshopper 1.0.7)
# plug-ins: Heteroptera, Kangaroo2 Components

crv = Curve(<curve referenced from the Rhino model>)
boundary = BoundarySurfaces(Edges=crv)
popgeo = PopulateGeometry(Geometry=boundary, Count=Slider(150, range=10..400), Seed=1)
number_slider = Slider(2.29, range=0..15)
button = Button()
cpc = CurvePointCollide(Points=popgeo, Curve=crv, Plane=PlaneXY(0, 0, 0), Interior=True, Strength=1)
sc = SphereCollide(Points=popgeo, Radius=number_slider, Strength=0.2)
B = Bomb(Location=popgeo, Points=popgeo, DetonationTime=button, Strength=5, Reset=button)
merge = Merge(Data1=cpc, Data2=sc, Data3=B)
crv_2 = Curve(crv)
solver = Solver(GoalObjects=merge, Reset=Button(), Threshold=1e-15, Tolerance=0.01, On=True)  # -> I, V, O
crv_cp = CurveClosestPoint(Point=solver.V, Curve=crv_2)  # -> Point, Parameter, Distance
Z = UnitZ(Factor=-1)
vec = Vector(Z)
dom = ConstructDomain(DomainStart=Slider(10, range=0..500), DomainEnd=Slider(115, range=0..500))
bnd = Bounds(Numbers=crv_cp.Distance)
remap = RemapNumbers(Value=crv_cp.Distance, Source=bnd, Target=Domain(0, 1))  # -> Mapped, Clipped
graph = GraphMapper(
    remap.Clipped,
    x0=0,
    x1=1,
    y0=0,
    y1=1,
    container_name="Bezier2",
    pt=[Point(0, 0, 0), Point(0.2237762213, 0.05072462559, 0), Point(0.4424138491, 0.2168728361, 0), Point(0.6293706298, 0.4202898741, 0), Point(0.769230783, 0.5724637508, 0), Point(0.7972028255, 0.9637681246, 0), Point(1, 1, 0)])
dom_2 = ConstructDomain(DomainStart=0, DomainEnd=Slider(3.6, range=0..5))
remap_2 = RemapNumbers(Value=graph, Source=Domain(0, 1), Target=dom)  # -> Mapped, Clipped
lng = ListLength(List=remap_2.Clipped)
randomize = RandomizeNumbers(Number=remap_2.Clipped, Ratio=0.2)
pt = Point(graft(solver.V))
random = Random(Range=dom_2, Number=lng, Seed=2)
addition = Addition(A=remap_2.Clipped, B=random)
num = Number(graft(addition))
line = LineSDL(Start=pt, Direction=vec, Length=num)
division = Division(A=num, B=Slider(10.8, range=0..40))
curvepoint = PointOnCurve(line, parameter=1)
round = Round(Number=division)  # -> Nearest, Floor, Ceiling
brep = Brep(<brep referenced from the Rhino model>)
bbox = BoundingBox(Content=brep, Plane=PlaneXY(0, 0, 0))  # -> Box, Box_2
popgeo_2 = PopulateGeometry(Geometry=line, Count=round.Floor, Seed=1, Points=curvepoint)
merge_2 = Merge(Data1=simplify(popgeo_2))
box = EvaluateBox(Box=bbox.Box, UParameter=0.5, VParameter=0.5, WParameter=0.5)  # -> Plane, Point, Include
boxprop = BoxProperties(Box=bbox.Box)  # -> Center, Diagonal, Area, Volume, Degeneracy
pdecon = Deconstruct(Point=boxprop.Diagonal)  # -> XComponent, YComponent, ZComponent
anchor = Anchor(Point=curvepoint, Target=curvepoint, Strength=10000)
oncurve = OnCurve(Points=merge_2, Curve=line, Strength=1)
num_2 = Number(expr("3.9*x", number_slider))
max = Maximum(A=pdecon.XComponent, B=pdecon.YComponent)
merge_3 = Merge(Data1=flatten(oncurve), Data2=flatten(anchor))
division_2 = Division(A=num_2, B=max)
scale = Scale(Geometry=brep, Center=box.Point, Factor=division_2)  # -> Geometry, Transform
solver_2 = Solver(GoalObjects=merge_3, Reset=Button(), Threshold=1e-15, Tolerance=0.01, On=True)  # -> I, V, O
pdecon_2 = Deconstruct(Point=solver_2.V)  # -> XComponent, YComponent, ZComponent
larger = LargerThan(FirstNumber=Slider(-7, range=-10..10), SecondNumber=pdecon_2.ZComponent)  # -> LargerThan, OrEqualTo
cull = CullPattern(List=solver_2.V, CullPattern=larger.LargerThan)
xy = XYPlane(Origin=cull)
orient = Orient(Geometry=scale.Geometry, Source=box.Plane, Target=xy)  # -> Geometry, Transform
material = CreateMaterial(
    Diffuse=ColourSwatch(SwatchColor=RGB(216, 237, 230)),
    Specular=ColourSwatch(SwatchColor=RGB(255, 255, 255)),
    Emission=RGB(0, 0, 0),
    Transparency=Slider(0.528, range=0..1),
    Shine=0)
material_2 = CreateMaterial(
    Diffuse=ColourSwatch(SwatchColor=RGB(216, 237, 230)),
    Specular=ColourSwatch(SwatchColor=RGB(255, 255, 255)),
    Emission=RGB(0, 0, 0),
    Transparency=Slider(0.528, range=0..1),
    Shine=0)
material_3 = CreateMaterial(
    Diffuse=ColourSwatch(SwatchColor=RGB(90, 110, 103)),
    Specular=ColourSwatch(SwatchColor=RGB(255, 255, 255)),
    Emission=RGB(0, 0, 0),
    Transparency=Slider(1, range=0..1),
    Shine=0)
pt_2 = Point(<point referenced from the Rhino model>)
preview = CustomPreview(Geometry=orient.Geometry, Material=material)
preview_2 = CustomPreview(Geometry=orient.Geometry, Material=material_2)
preview_3 = CustomPreview(Geometry=line, Material=material_3)
dist = Distance(PointA=cull, PointB=pt_2)
bnd_2 = Bounds(Numbers=dist)
dom_3 = ConstructDomain(DomainStart=Slider(0.04, range=0..1), DomainEnd=Slider(0.75, range=0..1))
lng_2 = ListLength(List=dist)
remap_3 = RemapNumbers(Value=dist, Source=bnd_2, Target=Domain(0, 1))  # -> Mapped, Clipped
random_2 = Random(Range=dom_3, Number=lng_2, Seed=2)
larger_2 = LargerThan(FirstNumber=random_2, SecondNumber=remap_3.Clipped)  # -> LargerThan, OrEqualTo
dispatch = Dispatch(List=orient.Geometry, DispatchPattern=larger_2.LargerThan)  # -> ListA, ListB
brep_2 = Brep(dispatch.ListA)
