# Grasshopper definition lamp_3.gh (Grasshopper 1.0.7)
# Copyright:  All rights reserved
# plug-ins: PTComponentLibrary

panel = Panel("""100 to 200
15 to 60
0.6 to 1.5
0.6 to 1.5
0.6 to 1.5
0.6 to 1.5
-0.2 to 0.2
-0.2 to 0.2
3 to 15
0 to 6*PI
0 to 1
0 to 6*PI""")
genes = GenePool(
    Decimals=2,
    Maximum=1,
    Minimum=0,
    Value=[0.07911665136, 0.899688967, 0.48, 1, 0.4214884394, 0, 0.5767153928, 0.6025891554, 0.7411971342, 0.387242716, 0.6284791122, 0.6499509619, 0.64840087, 0.8778570569, 0.878494319, 0.7532427817, 0.3641320143, 0.6662181512, 0.5163004932, 0.2334936728])
resolution = Slider(1.32, range=0.7..5)
panel_2 = Panel("""Height
Width
Width Ratio 0
Width Ratio 1/3
Width Ratio 2/3
Width Ratio 1
Depth Bottom
Depth Top
Wave 1 Counts
Twist 1 angle
Twist 1 dir
Wave 2 angle""")
panel_3 = Panel(panel_2)
resolution_2 = Number(resolution)
remap = RemapNumbers(Value=genes, Source=Domain(0, 1), Target=panel)  # -> Mapped, Clipped
panel_4 = Panel(remap.Mapped)
bang = ExplodeTree(Data=simplify(graft(remap.Mapped)))  # -> Branch0, Branch1, Branch2, Branch3, Branch4, Branch5, Branch6, Branch7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

# ----
# Width ratio
width_ratio_0 = Number(bang.Branch2)
width_ratio_1 = Number(bang.Branch2)
width_ratio_2 = Number(bang.Branch2)
width_ratio_3 = Number(bang.Branch2)
width = Number(bang.Branch1)
multiplication = Multiplication(A=width, B=width_ratio_0)
multiplication_2 = Multiplication(A=width, B=width_ratio_1)
multiplication_3 = Multiplication(A=width, B=width_ratio_2)
multiplication_4 = Multiplication(A=width, B=width_ratio_3)
width_0 = Number(multiplication)
width_1 = Number(multiplication_2)
width_2 = Number(multiplication_3)
width_3 = Number(multiplication_4)

sin_count = Number(bang.Branch8)
expression = Expression(x=sin_count, Expression="floor(x)")
sin_count_2 = Number(expression)

sin_count_3 = Number(sin_count_2)

# ----
# Height
resolution_3 = Number(resolution)
height = Number(bang.Branch0)
division = Division(A=height, B=resolution_3)
dom = ConstructDomain(DomainStart=0, DomainEnd=height)

height_count = Integer(division)

width_ratio_0_2 = Number(bang.Branch2)
width_ratio_1_2 = Number(bang.Branch3)
width_ratio_2_2 = Number(bang.Branch4)
width_ratio_3_2 = Number(bang.Branch5)
width_4 = Number(bang.Branch1)
height_count_2 = Integer(height_count)
multiplication_5 = Multiplication(A=width_4, B=width_ratio_0_2)
multiplication_6 = Multiplication(A=width_4, B=width_ratio_1_2)
multiplication_7 = Multiplication(A=width_4, B=width_ratio_2_2)
multiplication_8 = Multiplication(A=width_4, B=width_ratio_3_2)
range = Range(Domain=Domain(0, 1), Steps=height_count_2)
bezier = GhPythonScript(t=range, a=multiplication_5, b=multiplication_6, c=multiplication_7, d=multiplication_8)  # -> out, r
# ---------- bezier: Python ----------
__author__ = "TM20WC4"
__version__ = "2019.03.05"

import rhinoscriptsyntax as rs
from math import *

r=pow((1-t),3)*a+3*t*pow((1-t),2)*b+3*(pow(t,2))*(1-t)*c+pow(t,3)*d
# ---------- end bezier ----------
height_indexes = Number(range)
widths = Number(bezier.r)

twist_angle = Number(bang.Branch9)
height_indexes_2 = Number(range)
twist_dir = Number(bang.Branch10)
expression_2 = Expression(x=twist_angle, y=height_indexes_2, z=twist_dir, Expression="if(z≤0.5,x*y,-x*y)")
twist_angle_2 = Number(expression_2)

twist_angle_3 = Number(bang.Branch11)
height_indexes_3 = Number(range)
twist_dir_2 = Number(bang.Branch10)
expression_3 = Expression(x=twist_angle_3, y=height_indexes_3, z=twist_dir_2, Expression="if(z≥0.5,x*y,-x*y)")
twist_angle_4 = Number(expression_3)

height_indexes_4 = Number(range)
depth_bottom = Number(bang.Branch7)
depth_top = Number(bang.Branch6)
expression_4 = Expression(x=height_indexes_4, a=depth_bottom, b=depth_top, Expression="x*a+(1-x)*b")
depths = Number(expression_4)

range_2 = Range(Domain=dom, Steps=height_count)
height_list = Number(range_2)

height_count_3 = Integer(height_count)
height_count_4 = Integer(height_count)
twist_angle_5 = Number(twist_angle_4)
twist_angle_6 = Number(twist_angle_2)
height_list_2 = Number(range_2)
depth = Number(depths)
width_5 = Number(widths)

# ----
# Width
resolution_4 = Number(resolution)
width_6 = Number(bang.Branch1)

expression_5 = Expression(x=width_6, Expression="x*PI")

division_2 = Division(A=expression_5, B=resolution_4)
range_3 = Range(Domain=Domain(0, 6.283185307), Steps=division_2)
angle_list = Number(range_3)

angle_list_2 = Number(graft(range_3))
expression_6 = Expression(
    angle=angle_list_2,
    height=height_list_2,
    width=width_5,
    depth=depth,
    sinCount=sin_count_3,
    twistA=twist_angle_6,
    twistB=twist_angle_5,
    Expression="width+sin(angle*sinCount+twistA)*(depth*width)+cos(angle*sinCount+twistB)*(depth*width)")
pt = PointCylindrical(BasePlane=PlaneXY(0, 0, 0), Angle=angle_list_2, Radius=expression_6, Elevation=height_list_2)
ptwrap = WrapGrids(Grid=pt, Dir=0, Steps=1, Index=0)
ptcell = Cellulate(Grid=ptwrap)  # -> Wires, Cells, Meshes
preview = Preview(geo=ptcell.Meshes)

# ==== cluster Preview: Advanced preview cluster with better deffault preset
bool = ClusterInput()
col = ClusterInput()
geo = ClusterInput()
bool_2 = ClusterInput()
bool_3 = Boolean(True)
bool_4 = Boolean(bool)
col_2 = Colour(col)
col_3 = Colour(RGB(176, 176, 176))
geo_2 = Geometry(geo)
bool_5 = Boolean(bool_2)
bool_6 = Boolean(False)
if_empty = PythonScript(x=col_2, z=col_3)  # -> a; inputs x: Color, z: Color
# ---------- if_empty: Python ----------
if not x:
    a = z
else:
    a = x
# ---------- end if_empty ----------
if_empty_2 = PythonScript(x=bool_5, z=bool_6)  # -> a; same code as if_empty
if_empty_3 = PythonScript(x=bool_4, z=bool_3)  # -> a; same code as if_empty
gate = StreamGate(Stream=geo_2, Gate=if_empty_3)  # -> Target0, Target1
gate_2 = StreamGate(Stream=gate.Target1, Gate=if_empty_2)  # -> Target0, Target1
mesh = MeshBrep(
    Brep=gate_2.Target1,
    Settings={GridMaxCount=0, GridMinCount=16, JaggedSeams=False, MaxEdgeLength=0, MinEdgeLength=0.0001, MinTolerance=0, Refine=True, RefineAngle=0, RelativeTolerance=0.65, SimplePlanes=True, Tolerance=0})
preview = CustomPreview(Geometry=[mesh, gate_2.Target0], Shader=if_empty)
