# Grasshopper definition phdgh.gh (Grasshopper 1.0.7)
# plug-ins: Heteroptera, LunchBox, Kangaroo2 Components

srf = Surface(<surface referenced from the Rhino model>)
number_slider = Slider(0.4, range=0..1.5)
pt = Point(Point(0, 0, 9))
multiplication = Multiplication(A=number_slider, B=Slider(0.7, range=0..1.5))
xy = XYPlane(Origin=pt)
series = Series(Start=Slider(88, range=3..3000), Step=1, Count=Slider(7311, range=3..11000))
hex = HexagonCells(Surface=srf, UDivisions=Slider(32, range=2..40), VDivisions=Slider(11, range=2..40), TParameter=Slider(0.33, range=0..1))  # -> HexagonCells, simplify(graft(Centers))
expression = Expression(x=series, y=number_slider, Expression="sqrt(x)*y")
expression_2 = Expression(x=series, Expression="x*PI*(1+sqrt(5))")
disc = Discontinuity(Curve=hex.HexagonCells, Level=1)  # -> simplify(Points), Parameters
lng = ListLength(List=disc.Points)
crv = Curve(<curve referenced from the Rhino model>)
equals = Equality(FirstNumber=lng, SecondNumber="6")  # -> flatten(Equality), Inequality
tstat = TreeStatistics(Tree=disc.Points)  # -> Paths, Length, Count
pt_2 = PointCylindrical(BasePlane=xy, Angle=expression_2, Radius=expression, Elevation=0)
pt_3 = Point(pt)
jitter = Jitter(List=pt_2, Jitter=1, Seed=2)  # -> Values, Indices
cull = CullPattern(List=tstat.Paths, CullPattern=equals.Equality)
dist = Distance(PointA=pt_3, PointB=jitter.Values)
bnd = Bounds(Numbers=dist)
curvemapper = HeteroMapper(GraphCurve=crv, Numbers=dist, InputDomainOptional=bnd)
branch = TreeBranch(Tree=simplify(disc.Points), Path=cull, MaintainPaths=False)
branch_2 = TreeBranch(Tree=simplify(hex.Centers), Path=cull, MaintainPaths=False)
remap = RemapNumbers(Value=dist, Source=bnd, Target=Domain(0, 1))  # -> Mapped, Clipped
item = ListItem(List=branch, Index=0, Wrap=True)  # -> Item, Item1, Item2, Item3, Item4, Item5

# ---- group: Dithering on ValueWeighted Points
# LockRandom
points = Point(jitter.Values)
number_values = Number(curvemapper)
limit = ValueList({"CountNeighbors": 0, "DistanceNeighbors": 1}, selected="CountNeighbors")
count = Slider(6, range=0..20)
maxdistance_slow = Slider(12.5, range=0..110)
includepivot = BooleanToggle(False)
randomize = Slider(0.111, range=0..1)
seed = DigitScroller(Scroller_Digits=12, Scroller_Prefix="Seed", Scroller_Radix=11, Scroller_Value=3333)
distance_based_dithering = GhPythonScript(
    points=points,
    values=number_values,
    limit=limit,
    neighbours_count=count,
    max_distance=maxdistance_slow,
    pivot_include=includepivot,
    randomize_ratio=randomize)  # -> bool; inputs points: list of Point3d, values: list, limit: Boolean, neighbours_count: Int32, pivot_include: Boolean, random_seed: Int32
# ---------- distance_based_dithering: Python ----------
from ghpythonlib.componentbase import executingcomponent as component
import Grasshopper, GhPython
import System
import Rhino
import rhinoscriptsyntax as rs
from Rhino.Geometry import RTree
import ghpythonlib.treehelpers
import random

__author__ = "LUKÁŠ MATĚJA & PETR BOČEK"
__version__ = "2018.11.01"

class MyComponent(component):

    def RunScript(self, points, values, limit, neighbours_count, max_distance, pivot_include, randomize_ratio, random_seed=None):
        """
        Provides a scripting component.
        Inputs:
            points:     positions of the 3Dpoints to pick from
            values:     values on points
            limit_type: 0 = Count limit; 1 = Distance limit
        Output:
            P:          points
            i:          Indexes
            d:          Distances
        """

        #points = P
        limit = ('count', 'distance')[limit]
        neighbors_count = neighbours_count + 1
        random.seed(random_seed)
        #cull_pivot = not pivot_include
        #values = V
        #u = U

        #code
        if limit == 'count':
            r_tree = RTree.Point3dKNeighbors(points, points, neighbors_count)
        elif limit == 'distance':
            r_tree = RTree.Point3dClosestPoints(points, points, max_distance)

        neighbors_index_set = [list(item) for item in r_tree]

        neighbors_point_set = []
        neighbors_distance_set = []
        for indices in neighbors_index_set:
            neighbors_point_set.append([points[i] for i in indices])
            pivot = points[indices[0]]
            neighbors_distance_set.append([(points[i] - pivot).Length for i in indices])
        
        # I've removed this and kept it in original list for simplicity but it could be done both ways
        #data_set = (neighbors_Points, neighbors_index_set, neighbors_distance_set)
        #
        #if cull_pivot:
        #    data_set = [[item[cull_pivot:] for item in data] for data in data_set]
        #
        #print data_set
        ## output
        #P,i,d = [ghpythonlib.treehelpers.list_to_tree(data) for data in data_set]
        #[key.SimplifyPaths() for key in (P,i,d)]
        ## return outputs if you have them; here I try it for you:
        
        """
        if not(pivot_include):
            neighbors_point_set = neighbors_point_set[cull_pivot:]
            neighbors_index_set = neighbors_index_set[cull_pivot:]
            neighbors_distance_set = neighbors_distance_set[cull_pivot:]
        print neighbors_index_set,len(neighbors_index_set)
        """
        
        for i,neighbour in enumerate(neighbors_index_set):
            j = 0
            while j < len(neighbour):
                if neighbour[j] <= i:
                    del neighbors_index_set[i][j]
                    del neighbors_distance_set[i][j]
                else:
                    j += 1
        #print neighbors_index_set

        for i in range(len(values)):
            rounded = round(values[i])
            error = values[i] - rounded
            values[i] = rounded
            error_sum = sum(neighbors_distance_set[i])
            for j in range(len(neighbors_index_set[i])):
                values[neighbors_index_set[i][j]] += error * ( ( neighbors_distance_set[i][j] * random.uniform(1-randomize_ratio, 1+randomize_ratio)) / error_sum )
        bool = values
        return bool
# ---------- end distance_based_dithering ----------
cull_2 = CullPattern(List=points, CullPattern=distance_based_dithering)

# ----
merge = Merge(Data1=item.Item2, Data2=item.Item3, Data3=item.Item4, Data4=branch_2)
merge_2 = Merge(Data1=item.Item, Data2=item.Item1, Data3=item.Item2, Data4=branch_2)
merge_3 = Merge(Data1=item.Item4, Data2=item.Item5, Data3=item.Item, Data4=branch_2)
merge_4 = Merge(Data1=item.Item3, Data2=item.Item4, Data3=item.Item5, Data4=branch_2)
pline = PolyLine(Vertices=merge_3, Closed=True)
pline_2 = PolyLine(Vertices=merge_2, Closed=True)
pline_3 = PolyLine(Vertices=merge, Closed=True)
pline_4 = PolyLine(Vertices=merge_4, Closed=True)
Z = UnitZ(Factor=expr("-x", 1))
merge_5 = Merge(Data1=pline_2, Data2=pline_3, Data3=pline)  # -> flatten(Result)
pcen = PolygonCenter(Polyline=merge_5)  # -> CenterV, CenterE, CenterA
num = Number(Slider(0.82, range=0.1..1))
vec = Vector(Z)
scale = Scale(Geometry=merge_5, Center=pcen.CenterV, Factor=num)  # -> Geometry, Transform
pt_4 = Point(pcen.CenterV)
crv_2 = Curve(scale.Geometry)
brep = Brep(<brep referenced from the Rhino model>)
project = ProjectPoint(Point=cull_2, Direction=vec, Geometry=brep)  # -> Point, Index
srf_cp = SurfaceClosestPoint(Point=project.Point, Surface=brep)  # -> Point, UVPoint, Distance
evalsrf = EvaluateSurface(Surface=brep, Point=srf_cp.UVPoint)  # -> Point, Normal, UDirection, VDirection, Frame
cir = Circle(Plane=evalsrf.Frame, Radius=multiplication)
dot = DotDisplay(Point=evalsrf.Point)
sph = Sphere(Base=evalsrf.Point, Radius=1)
