# Grasshopper definition phdgh_2.gh (Grasshopper 1.0.7)
# Copyright:  All rights reserved
# plug-ins: PTComponentLibrary

srf = Surface(<surface referenced from the Rhino model>)
box = Box(srf)
brep = Brep(<brep referenced from the Rhino model>)
range = Range(Domain=Domain(0, 1), Steps=Slider(49, range=0..100))
range_2 = Range(Domain=Domain(0, 1), Steps=Slider(59, range=0..100))
srf_2 = Surface(box)
ptsrfparam = SurfaceParameter(Surface=srf_2, UParam=range, VParam=range_2, Normalize=True)
ptcell = Cellulate(Grid=ptsrfparam)  # -> Wires, Cells, Meshes
item = ListItem(List=ptcell.Cells, Index=0, Wrap=True)  # -> Item, Item1, Item2, Item3
pt = Point(item.Item)
pt_2 = Point(item.Item3)
pt_3 = Point(item.Item2)
eval = Evaluate(F="(x+y)/2", x=pt_2, y=pt_3)
eval_2 = Evaluate(F="(x+y)/2", x=pt, y=pt_3)
pt_4 = Point(item.Item1)
eval_3 = Evaluate(F="(x+y)/2", x=pt_4, y=pt_3)
ln = Line(StartPoint=eval_3, EndPoint=eval)
ln_2 = Line(StartPoint=pt, EndPoint=eval_2)
number_slider = Slider(0.22, range=0..5)
merge = Merge(Data1=ln, Data2=ln_2)  # -> flatten(Result)
ext = ExtendCurve(Curve=merge, Type=0, Start=expr("-x", number_slider), End=expr("-x", number_slider))
offset = OffsetCurve(Curve=ext, Distance=expr("-x", number_slider), Plane=PlaneXY(0, 0, 0), Corners=1)
offset_2 = OffsetCurve(Curve=ext, Distance=number_slider, Plane=PlaneXY(0, 0, 0), Corners=1)
flip = FlipCurve(Curve=offset_2)  # -> Curve, Flag
flip_2 = FlipCurve(Curve=offset)  # -> Curve, Flag
blendc = BlendCurve(CurveA=offset_2, CurveB=flip_2.Curve, BulgeA=1, BulgeB=1, Continuity=2)
blendc_2 = BlendCurve(CurveA=flip.Curve, CurveB=offset, BulgeA=1, BulgeB=1, Continuity=2)
merge_2 = Merge(Data1=offset_2, Data2=offset, Data3=blendc, Data4=blendc_2)
join = JoinCurves(Curves=merge_2, Preserve=False)
